# Grasshopper definition tensegritydemo 3prism_2026.gh (Grasshopper 1.0.8)
# plug-ins: Karamba3D, Opossum2_0_Proto_B, Bifocals, Opossum2_0_Proto_A

# ---- group: Top
unit_z = UnitZ(Factor=Slider(1.2, range=0..10))
top_radius = Slider(0.5, range=0.5..1.5)
xy_plane = XYPlane(Origin=unit_z)
polygon = Polygon(Plane=xy_plane, Radius=top_radius, Segments=Slider(3, range=0..10), FilletRadius=0)  # -> Polygon, Length

# ---- group: Bottom
unit_z_2 = UnitZ(Factor=Slider(0, range=0..10))
bottom_radius = Slider(0.5, range=0.5..1.5)
xy_plane_2 = XYPlane(Origin=unit_z_2)
polygon_2 = Polygon(Plane=xy_plane_2, Radius=bottom_radius, Segments=Slider(3, range=0..10), FilletRadius=0)  # -> Polygon, Length

# ---- group: Rotation
rotate_angle = Slider(147.898, range=0..360)
rotate = Rotate(Geometry=polygon.Polygon, Angle=degrees(rotate_angle), Plane=PlaneXY(0, 0, 0))  # -> Geometry, Transform

# ---- group: Bottom point
curve = Curve(polygon_2.Polygon)
divide_curve = DivideCurve(Curve=curve, Count=Slider(3, range=0..10), Kinks=False)  # -> Points, Tangents, Parameters
explode_object = ExplodeObject(Object=curve, Recursive=False)
list_item = ListItem(List=divide_curve.Points, Index=0, Wrap=True)  # -> Item, Item1, Item2

# ---- group: Top point
curve_2 = Curve(rotate.Geometry)
divide_curve_2 = DivideCurve(Curve=curve_2, Count=Slider(3, range=0..10), Kinks=False)  # -> Points, Tangents, Parameters
explode_object_2 = ExplodeObject(Object=curve_2, Recursive=False)
list_item_2 = ListItem(List=divide_curve_2.Points, Index=0, Wrap=True)  # -> Item, Item1, Item2

# ----
number_slider = Slider(0.05, range=0..0.1)  # disabled

# ---- group: Structure
polyline = PolyLine(Vertices=[list_item.Item2, list_item_2.Item2], Closed=False)
polyline_2 = PolyLine(Vertices=[list_item.Item1, list_item_2.Item1], Closed=False)
polyline_3 = PolyLine(Vertices=[list_item_2.Item, list_item.Item], Closed=False)
structure = Curve([polyline_3, polyline_2, polyline])

# ---- group: Cable
polyline_4 = PolyLine(Vertices=[list_item_2.Item2, list_item.Item], Closed=False)
polyline_5 = PolyLine(Vertices=[list_item_2.Item1, list_item.Item2], Closed=False)
polyline_6 = PolyLine(Vertices=[list_item_2.Item, list_item.Item1], Closed=False)
structure_2 = Curve([polyline_6, polyline_5, polyline_4, explode_object_2, explode_object])

# ----
number_slider_2 = Slider(50, range=0..50)  # disabled
number_slider_3 = Slider(1.007, range=0..10)  # disabled
number_slider_4 = Slider(3, range=0..10)  # disabled
number_slider_5 = Slider(40, range=0..100)  # disabled
number_slider_6 = Slider(950, range=0..1000)  # disabled
number_slider_7 = Slider(100, range=0..100)  # disabled
panel = Panel("200e-06")  # disabled
bottom_point = Point(divide_curve.Points)

struts = Curve(structure)
cables = Curve(structure_2)

top_point = Point(divide_curve_2.Points)
各向同性 = 材料属性Karamba3D(
    截面系列="Steel",
    名称="PE",
    弹性模量_kN_cm²=number_slider_7,
    面内剪切模量_kN_cm²=number_slider_5,
    横向剪切模量_kN_cm²=number_slider_4,
    容重_kN_m³=number_slider_6,
    热膨胀系数_1=panel,
    抗拉强度_kN_cm²=number_slider_2,
    抗压强度_kN_cm²=number_slider_3,
    强度假设="MISES",
    mode="Isotrop")  # disabled

# ---- group: CABLES
截面范围选择器 = 截面范围选择器Karamba3D(最大高度_cm=-1, 最大宽度_cm=-1, menu=[dropdown(1), dropdown(2), dropdown(4), dropdown(0)])  # disabled
panel_2 = Panel(截面范围选择器)  # disabled
panel_3 = Panel("""0
1
2""")  # disabled
panel_4 = Panel("""3
4
6""")  # disabled
cull_i = CullIndex(List=截面范围选择器, Indices=panel_3, Wrap=True)  # disabled
item = ListItem(List=截面范围选择器, Index=panel_4, Wrap=True)  # disabled

# ----
number_slider_8 = Slider(1, range=0..1)  # disabled

# ---- group: Kangeroo simulation / Character of Cable / Cable pre-tension
slider = Slider(0.861, range=0..1)

# ---- group: Kangeroo simulation / Character of Cable
divide_domain = DivideDomain(Domain=Domain(0, 1), Count=10)
panel_5 = Panel(divide_domain)
sub_curve = SubCurve(BaseCurve=reparameterize(graft(cables)), Domain=divide_domain)
subtraction = Subtraction(A="1", B=slider)
length = Length(Curve=sub_curve)
line = Line(sub_curve)
cable_lenght = Panel(line)
multiplication = Multiplication(A=length, B=subtraction)
panel_6 = Panel(multiplication)
length_line = LengthLine(Line=line, Length=multiplication, Strength=10)

# ---- group: CABLE PRETENSION
number_slider_9 = Slider(0.5, range=0..100)  # disabled

# ---- group: Kangeroo simulation / kN
load_per_upper_node_p = Slider(0.559, range=0..1)

# ----
number_slider_10 = Slider(0.1, range=0..1)  # disabled

# ---- group: 荷载 (Karamba3D)
重力 = 荷载Karamba3D(向量=Vector(0, 0, -1), 荷载工况="LC0", mode="Gravity")  # disabled

# ---- group: Kangeroo simulation
boolean_toggle = BooleanToggle(True)
trigger = Timer(Interval=1, TimerInterval=5, Target=bouncysolver)

unit_z_3 = UnitZ(Factor=expr("-x", load_per_upper_node_p))
load = Load(Point=top_point, ForceVector=unit_z_3, Weighting=1)
length_line_2 = LengthLine(Line=struts, Strength=10)
anchor = Anchor(Point=bottom_point, Strength=10000)
vector_display = VectorDisplay(Anchor=top_point, Vector=unit_z_3)
bouncysolver = BouncySolver(
    GoalObjects=[length_line, anchor, length_line_2, load],
    Reset=boolean_toggle,
    Threshold=1e-15,
    Tolerance=0.0001,
    Damping=0.99,
    Iterations=10,
    On=True)  # -> I, V, O

# ---- group: Opossum objective - loaded versus unloaded equilibrium
# Read me: Minimize OBJECTIVE. Compare same-angle equilibria with and without external load. Prestress retained in both. Units: model m. Iteration-limit cases receive 1e6. This is a displacement objective, not a stability or strength certificate. Last 3 solver outputs are tracked Show points: keep Show last.
length_line_3 = LengthLine(Line=line, Length=multiplication, Strength=10)
anchor_2 = Anchor(Point=bottom_point, Strength=10000)
length_line_4 = LengthLine(Line=struts, Strength=10)
length_line_5 = LengthLine(Line=line, Length=multiplication, Strength=10)
anchor_3 = Anchor(Point=bottom_point, Strength=10000)
length_line_6 = LengthLine(Line=struts, Strength=10)
load_2 = Load(Point=top_point, ForceVector=unit_z_3, Weighting=1)
solver_threshold = Panel("0.0000000000000001")
show_upper_3_nodes = Show(G=top_point)
show_upper_3_nodes_2 = Show(G=top_point)
ordered_goals_show_last = Merge(
    Data1=flatten(length_line_5),
    Data2=flatten(anchor_3),
    Data3=flatten(length_line_6),
    Data4=flatten(load_2),
    Data5=flatten(show_upper_3_nodes_2))
ordered_goals_show_last_2 = Merge(Data1=flatten(length_line_3), Data2=flatten(anchor_2), Data3=flatten(length_line_4), Data4=flatten(show_upper_3_nodes))
maximum_iterations = Panel("10000")
zombie_loaded = ZombieSolver(
    GoalObjects=flatten(ordered_goals_show_last),
    Threshold=solver_threshold,
    Tolerance=1e-06,
    MaxIterations=maximum_iterations)  # -> I, V, O
loaded_iterations = Panel(zombie_loaded.I)
zombie_unloaded = ZombieSolver(
    GoalObjects=flatten(ordered_goals_show_last_2),
    Threshold=solver_threshold,
    Tolerance=1e-06,
    MaxIterations=maximum_iterations)  # -> I, V, O
unloaded_iterations = Panel(zombie_unloaded.I)
unloaded_stopped_before_limit = SmallerThan(FirstNumber=zombie_unloaded.I, SecondNumber=maximum_iterations)  # -> SmallerThan, OrEqualTo
last_3_outputs_tracked_upper_nodes = Panel("""-3
-2
-1""")
track_upper_3_unloaded = ListItem(List=flatten(zombie_unloaded.O), Index=last_3_outputs_tracked_upper_nodes, Wrap=True)
track_upper_3_loaded = ListItem(List=flatten(zombie_loaded.O), Index=last_3_outputs_tracked_upper_nodes, Wrap=True)
loaded_stopped_before_limit = SmallerThan(FirstNumber=zombie_loaded.I, SecondNumber=maximum_iterations)  # -> SmallerThan, OrEqualTo
unloaded_upper_nodes = Point(track_upper_3_unloaded)
loaded_upper_nodes = Point(track_upper_3_loaded)
both_solvers_stopped_before_limit = GateAnd(A=unloaded_stopped_before_limit.SmallerThan, B=loaded_stopped_before_limit.SmallerThan)
upper_node_displacements = Distance(PointA=unloaded_upper_nodes, PointB=loaded_upper_nodes)
bnd = Bounds(Numbers=flatten(upper_node_displacements))
iteration_limit_penalty = Panel("1000000")
displacement_of_3_nodes_m = Panel(upper_node_displacements)
dedomain = DeconstructDomain(Domain=bnd)  # -> Start, End
raw_maximum_displacement_m = Number(dedomain.End)
reject_iteration_limit_results = StreamFilter(Gate=both_solvers_stopped_before_limit, Stream0=iteration_limit_penalty, Stream1=raw_maximum_displacement_m)
objective_minimize_upper_displacement = Number(reject_iteration_limit_results)
objective_minimize = Panel(objective_minimize_upper_displacement)

# ---- group: Opossum
opossum = Opossum(
    OpossumData_objective=[obj_1_minimize_negative_load, obj_2_minimize_displacement_m],
    OpossumData_simulator=[zombie_unloaded, zombie_loaded],
    OpossumData_variable=[rotate_angle, load_per_upper_node_p])
performance_explorer = PerformanceExplorer()
galapagos = Galapagos()
fitness_landscape = FitnessLandscape(Count=-1, ColourMode=1, ContourMode=2, Remap=False)
gene_pool = GenePool(Decimals=2, Maximum=100, Minimum=0, Value=[50, 50, 50, 50.37, 50, 50, 50, 50, 50, 50])

# ----
trigger_2 = Trigger(Interval=-1000, TimerInterval=1000, Target=opossum)

# ---- group: Outcome of curve and point
geometry = Geometry(zombie_loaded.O)
length_2 = Length(Curve=geometry)
lng = ListLength(List=divide_domain)
larger_than = LargerThan(FirstNumber=length_2, SecondNumber=Slider(1, range=0..10))  # -> LargerThan, OrEqualTo
dispatch = Dispatch(List=geometry, DispatchPattern=larger_than.LargerThan)  # -> ListA, ListB
geometry_2 = Geometry(dispatch.ListA)
geometry_3 = Geometry(dispatch.ListB)
clean = CleanTree(RemoveNulls=True, RemoveInvalid=True, RemoveEmpty=False, Tree=geometry_3)
partition = PartitionList(List=flatten(clean), Size=lng)
join = JoinCurves(Curves=partition, Preserve=False)
end_points = EndPoints(Curve=geometry_2)  # -> Start, End
end = EndPoints(Curve=join)  # -> Start, End
ln = Line(StartPoint=end.Start, EndPoint=end.End)
point = Point([end_points.End, end_points.Start])
z_分界高度_h = Slider(0.5, range=0..1)
all_9_cables = Line(flatten(ln))
提取_xyz = DeconstructPoint(Point=point, System=PlaneXY(0, 0, 0), rhinomcp_alias="z_coordinates", rhinomcp_graph_id="kangaroo_z_split_20261027")  # -> XCoordinate, YCoordinate, ZCoordinate
larger_than_2 = LargerThan(FirstNumber=提取_xyz.ZCoordinate, SecondNumber=z_分界高度_h)  # -> LargerThan, OrEqualTo
structure_3 = Curve(geometry_2)
split = SplitList(List=all_9_cables, Index=3)  # -> ListA, ListB
z_高度 = Panel(提取_xyz.ZCoordinate)
split_2 = SplitList(List=split.ListB, Index=3)  # -> ListA, ListB
panel_7 = Panel(larger_than_2.LargerThan)
按_z_分组 = Dispatch(
    List=point,
    DispatchPattern=larger_than_2.LargerThan,
    rhinomcp_alias="split_by_z",
    rhinomcp_graph_id="kangaroo_z_split_20261027")  # -> ListA, ListB
上层点_z_h = Point(按_z_分组.ListA)
下层点_z_h = Point(按_z_分组.ListB, rhinomcp_alias="lower_points", rhinomcp_graph_id="kangaroo_z_split_20261027")
upper_triangle_3_cables = Line(split_2.ListA)
connecting_3_cables = Line(split.ListA)
lower_triangle_3_cables = Line(split_2.ListB)

geometry_4 = Geometry(zombie_unloaded.O)
length_3 = Length(Curve=geometry_4)
larger_than_3 = LargerThan(FirstNumber=length_3, SecondNumber=Slider(1, range=0..10))  # -> LargerThan, OrEqualTo
dispatch_2 = Dispatch(List=geometry_4, DispatchPattern=larger_than_3.LargerThan)  # -> ListA, ListB
geometry_5 = Geometry(dispatch_2.ListA)
geometry_6 = Geometry(dispatch_2.ListB)
end_points_2 = EndPoints(Curve=geometry_5)  # -> Start, End
pipe = Pipe(Curve=geometry_5, Radius=Slider(0.03, range=0..0.5), Caps=0)  # disabled

# ---- group: Outcome of curve and point / Native components: 90 segments to 9 cables
clean_2 = CleanTree(RemoveNulls=True, RemoveInvalid=True, RemoveEmpty=False, Tree=geometry_6)
lng_2 = ListLength(List=divide_domain)
partition_2 = PartitionList(List=flatten(clean_2), Size=lng_2)
join_2 = JoinCurves(Curves=partition_2, Preserve=False)
end_2 = EndPoints(Curve=join_2)  # -> Start, End
ln_2 = Line(StartPoint=end_2.Start, EndPoint=end_2.End)
all_9_cables_2 = Line(flatten(ln_2))
split_3 = SplitList(List=all_9_cables_2, Index=3)  # -> ListA, ListB
split_4 = SplitList(List=split_3.ListB, Index=3)  # -> ListA, ListB
connecting_3_cables_2 = Line(split_3.ListA)
upper_triangle_3_cables_2 = Line(split_4.ListA)
lower_triangle_3_cables_2 = Line(split_4.ListB)

# ----
cables_2 = Geometry(all_9_cables_2)  # disabled
panel_8 = Panel("cable")  # disabled
# Input
panel_9 = Panel("strut")  # disabled
struts_2 = Geometry(geometry_5)  # disabled
panel_10 = Panel("desk")  # disabled
panel_11 = Panel("LC0")  # disabled

explode = Explode(Curve=cables_2, Recursive=True)  # -> Segments, Vertices; disabled
crv = Curve(explode.Segments)  # disabled
line_2 = Line(crv)  # disabled

linedim = LineDimension(Line=struts_2, Text="{0:0.00}", Size=number_slider)  # disabled

end_3 = EndPoints(Curve=struts_2)  # -> Start, End; disabled
支撑件 = 支座Karamba3D(位置序号=end_3.Start, Ct_kN_m=Vector(0, 0, 0), Cr_kNm_rad=Vector(0, 0, 0), menu=[buttons(off, off, on, off, off, off)])  # disabled

# ---- group: NEW DESK
pline = PolyLine(Vertices=end_3.End, Closed=invert(False))  # disabled
geo = Geometry(<curve referenced from the Rhino model>)  # disabled
area = Area(Geometry=pline)  # -> Area, Centroid; disabled
area_2 = Area(Geometry=geo)  # -> Area, Centroid; disabled
vec2pt = Vector2Pt(PointA=area_2.Centroid, PointB=area.Centroid, Unitize=False)  # -> Vector, Length; disabled
move = Move(Geometry=geo, Motion=vec2pt.Vector)  # -> Geometry, Transform; disabled

# ---- group: JOINTS
梁单元_释放 = 梁单元释放Karamba3D(
    梁单元编号=panel_9,
    起始节点Ct_kN_m=Vector(0, 0, 0),
    起始节点Cr_kNm_rad=Vector(0, 0, 0),
    终端节点Ct_kN_m=Vector(0, 0, 0),
    终端节点Cr_kNm_rad=Vector(0, 0, 0),
    menu=[buttons(off, off, off, off, off, off), buttons(on, on, on, on, on, on)])  # disabled

# ---- group: GRAVITY LOAD
重力_2 = 荷载Karamba3D(向量=Vector(0, 0, -1), 荷载工况=panel_11, mode="Gravity")  # disabled

# ---- group: CABLE PRETENSION / 荷载 (Karamba3D)
初始应变 = 荷载Karamba3D(初始应变=number_slider_9, 单元编号=panel_8, 荷载工况=panel_11, mode="InitialStrain")  # disabled

# ----
ext_offest = Slider(0.249, range=0..1)  # disabled
int_offest = Slider(0.191, range=0..1)  # disabled
number_slider_11 = Slider(0.053183, range=0..0.1)  # disabled
number_slider_12 = Slider(0.515, range=0..1)  # disabled
number_slider_13 = Slider(0.38, range=0..1)  # disabled
fillet_radius = Slider(0.06, range=0..1)  # disabled
desk_geometry = DeskGeometry(
    geo=end_3.End,
    F=number_slider_11,
    t=number_slider_12,
    D=ext_offest,
    B=int_offest,
    R=fillet_radius,
    mres=number_slider_13)  # -> C, C_2, L, mesh; disabled

# ---- group: CABLES
线转梁 = 创建线单元Karamba3D(
    线=line_2,
    编号=panel_8,
    截面=截面范围选择器,
    极限距离_m=0.005,
    Y向屈曲长度_m=-1,
    Z向屈曲长度_m=-1,
    侧扭屈曲长度_m=-1,
    弯曲=True,
    转折线最大角度=0.03,
    转多段线容差=0.01,
    转多段线最大边长=0.25,
    新建=True,
    删除=True,
    mode="LineToBeam",
    GuidGeneratorSeed=-1518674337)  # -> 单元, 点, 信息; disabled

# ---- group: DESK
材料选择 = 材料选择集Karamba3D(单元ID=panel_10, menu=[dropdown(1), dropdown(2), dropdown(2)])  # disabled
number_slider_14 = Slider(12, range=0..100)  # disabled
series = Series(Start=0.5, Step=0.5, Count=number_slider_14)  # disabled
壳体截面 = 截面Karamba3D(截面系列名称="DefaultCroSec", 单元ID=panel_10, 材料=材料选择, 高度_cm=series, mode="Shell - Const")  # disabled
panel_12 = Panel(series)  # disabled
panel_13 = Panel(壳体截面)  # disabled

# ---- group: Brep网格划分 (Karamba3D)
brep网格划分 = Brep网格划分Karamba3D(Brep=move.Geometry, 相交点=end_3.End, 网格大小=1, 边缘细分系数=number_slider_10, 点缩减=False, 平滑步长=0, 平滑迭代次数=5)  # -> 网格, 信息; disabled

# ----
number_slider_15 = Slider(23, range=0..100)  # disabled
材料选择_2 = 材料选择集Karamba3D(单元ID=panel_9, menu=[dropdown(1), dropdown(2), dropdown(2)])  # disabled
series_2 = Series(Start=2, Step=0.5, Count=number_slider_15)  # disabled
圆形截面 = 截面Karamba3D(截面系列名称="DefaultCroSec", 单元ID=panel_9, 材料=材料选择_2, 直径_cm=series_2, 壁厚_cm=expr("x/2", series_2), mode="Circular Hollow")  # disabled
panel_14 = Panel(series_2)  # disabled
panel_15 = Panel("""0
1""")  # disabled
panel_16 = Panel(圆形截面)  # disabled

# ---- group: DESK
area_3 = Area(Geometry=brep网格划分.网格)  # -> Area, Centroid; disabled
panel_17 = Panel(area_3.Area)  # disabled
网格转壳 = 创建曲面单元Karamba3D(网格=brep网格划分.网格, 编号=panel_10, 截面=壳体截面, 极限距离_m=0.005, 弯曲=True, mode="MeshToShell", GuidGeneratorSeed=782702785)  # -> 单元, 点, 信息; disabled

# ----
cull_i_2 = CullIndex(List=圆形截面, Indices=panel_15, Wrap=True)  # disabled

# ---- group: LIVE LOAD
number_slider_16 = Slider(0.8, range=0..1)  # "KN/m2"; disabled
Z = UnitZ(Factor=expr("-x", number_slider_16))  # disabled
vdis = VectorDisplay(Anchor=网格转壳.点, Vector=Z)  # disabled

# ----
线转梁_2 = 创建线单元Karamba3D(
    线=struts_2,
    编号=panel_9,
    截面=圆形截面,
    极限距离_m=0.005,
    Y向屈曲长度_m=-1,
    Z向屈曲长度_m=-1,
    侧扭屈曲长度_m=-1,
    弯曲=True,
    转折线最大角度=0.03,
    转多段线容差=0.01,
    转多段线最大边长=0.25,
    新建=True,
    删除=True,
    mode="LineToBeam",
    GuidGeneratorSeed=-1411999891)  # -> 单元, 点, 信息; disabled

# ---- group: LIVE LOAD / 荷载 (Karamba3D)
网格荷载常量 = 荷载Karamba3D(
    向量=Z,
    网格=brep网格划分.网格,
    单元编号=panel_10,
    荷载工况=panel_11,
    mode="MeshLoad -Const.",
    menu=[buttons(on, off, off), buttons(on, on)])  # disabled

# ---- group: ANALYZE & OPTIMIZE CROSS SECTION / 模型构建 (Karamba3D)
模型构建 = 模型构建Karamba3D(
    单元=flatten([线转梁_2.单元, 线转梁.单元, 网格转壳.单元]),
    支座=flatten(支撑件),
    荷载=flatten([网格荷载常量, 重力_2, 初始应变]),
    梁端释放=flatten(梁单元_释放),
    极限距离_m=0.005)  # -> 模型, 信息, 质量_kg, 重心, 荷载工况名称; disabled

# ---- group: ANALYZE & OPTIMIZE CROSS SECTION / 截面优化(Karamba3D)
优化截面 = 截面优化Karamba3D(
    模型=模型构建.模型,
    单元编号=flatten(panel_9),
    截面=flatten(cull_i_2),
    最大利用率=1,
    最大位移_cm=-1,
    MaximumVirtualWork_kNcm=0.01,
    利用率迭代次数=5,
    位移迭代次数=5,
    NumberOfDisplacementIncrementsPerIteration=2,
    DisplacementTolerance=0.01,
    采样点数=3,
    弹性设计=True,
    材料安全系数gammaM0=1,
    材料安全系数gammaM1=1.1,
    侧移框架=True)  # -> 优化后的模型, 信息, 质量_kg, 最大位移_cm, 弹性能量变化_kNm, 最大利用率视图不足截面, 最大位移视图限值截面; disabled

优化截面_2 = 截面优化Karamba3D(
    模型=优化截面.优化后的模型,
    单元编号=panel_8,
    截面=cull_i,
    最大利用率=1,
    最大位移_cm=-1,
    MaximumVirtualWork_kNcm=0.01,
    利用率迭代次数=5,
    位移迭代次数=5,
    NumberOfDisplacementIncrementsPerIteration=2,
    DisplacementTolerance=0.01,
    采样点数=3,
    弹性设计=True,
    材料安全系数gammaM0=1,
    材料安全系数gammaM1=1.1,
    侧移框架=True)  # -> 优化后的模型, 信息, 质量_kg, 最大位移_cm, 弹性能量变化_kNm, 最大利用率视图不足截面, 最大位移视图限值截面; disabled

优化截面_3 = 截面优化Karamba3D(
    模型=优化截面_2.优化后的模型,
    单元编号=panel_10,
    截面=壳体截面,
    最大利用率=1,
    最大位移_cm=-1,
    MaximumVirtualWork_kNcm=0.01,
    利用率迭代次数=5,
    位移迭代次数=5,
    NumberOfDisplacementIncrementsPerIteration=2,
    DisplacementTolerance=0.01,
    采样点数=3,
    弹性设计=True,
    材料安全系数gammaM0=1,
    材料安全系数gammaM1=1.1,
    侧移框架=True)  # -> 优化后的模型, 信息, 质量_kg, 最大位移_cm, 弹性能量变化_kNm, 最大利用率视图不足截面, 最大位移视图限值截面; disabled

# ---- group: ANALYZE & OPTIMIZE CROSS SECTION / 解析 (Karamba3D)
解析_analyse = 解析Karamba3D(模型=[优化截面_3.优化后的模型, 优化截面.优化后的模型], 荷载工况=panel_11)  # -> 分析结果模型, 最大位移_cm, 合力_kN, 弹性能量变化_kNm; disabled

# ----
# Finite Element Analysis
number = Number(解析_analyse.最大位移_cm)  # disabled

# ---- group: ANALYZE & OPTIMIZE CROSS SECTION
panel_18 = Panel(模型构建.模型)  # disabled
panel_19 = Panel(解析_analyse.合力_kN)  # disabled
panel_20 = Panel(number)  # disabled

# ---- group: 模型视图 (Karamba3D)
模型视图 = 模型视图Karamba3D(
    模型=解析_analyse.分析结果模型,
    menu=[checkbox(on), slider(0), checkbox(off), slider(1), checkbox(off), slider(0.16), slider(0.16), checkbox(off), slider(0.08), checkbox(off), slider(1), checkbox(off), slider(1), checkbox(off), checkbox(off), slider(1), slider(100), slider(0), buttons(on, off), slider(0.11), slider(0.01), checkbox(off), checkbox(off), checkbox(off), checkbox(on), checkbox(off), checkbox(off), checkbox(off), buttons(off, off, off), buttons(on, on), dropdown(1), dropdown(0)])  # -> 模型, 变形后的网格, 变形后的轴线, 变形后的模型, 最大变形; disabled

# ---- group: BEAMS / 梁单元视图 (Karamba3D)
梁视图 = 梁单元视图Karamba3D(
    模型=模型视图.模型,
    menu=[checkbox(off), checkbox(off), slider(0.04), slider(0.04), checkbox(off), checkbox(off), checkbox(off), checkbox(on), checkbox(off), checkbox(off), buttons(off, on, off, off, off, off, off, off, off, off, off, off, off, off, off, off, off, off, off, off), slider(1), slider(3)])  # -> 模型, 渲染梁单元的网格, 变形后的梁单元轴线, 图例颜色, 图例标签; disabled

# ---- group: SHELL / 壳单元视图 (Karamba3D)
壳体视图 = 壳单元视图Karamba3D(
    模型=模型视图.模型,
    层序号=0,
    menu=[checkbox(off), slider(1), buttons(on, off, off, off, off, off, off), slider(0), checkbox(off), slider(1)])  # -> 模型, 渲染壳单元的网格, 图例颜色, 图例标签; disabled

# ---- group: BEAMS
梁的力 = 截面力Karamba3D(分析结果模型=梁视图.模型, Ts=[0, 1])  # -> 模型, 轴力_kN, 剪力Vz_kN, 剪力Vy_kN, 扭矩Mt_kNm, 弯矩My_kNm, 弯矩Mz_kNm, 荷载工况序号; disabled
legend = LegendKaramba3D(
    Colors=梁视图.图例颜色,
    Tags=梁视图.图例标签,
    Scale=0.8,
    Textsize=30,
    Legend_HasHeader=False,
    Legend_Justification=2,
    Legend_Position=3)  # disabled
legend_2 = Legend(Colour=梁视图.图例颜色, Tags=梁视图.图例标签, LegendType=1)  # disabled
panel_21 = Panel(梁的力.轴力_kN)  # disabled

# ---- group: SHELL
legend_3 = LegendKaramba3D(
    Colors=壳体视图.图例颜色,
    Tags=壳体视图.图例标签,
    Scale=0.8,
    Textsize=30,
    Legend_HasHeader=False,
    Legend_Justification=2,
    Legend_Position=2)  # disabled
legend_4 = Legend(Colour=壳体视图.图例颜色, Tags=壳体视图.图例标签, LegendType=1)  # disabled

# ---- group: STRUTS
单元查询_elemquery_0 = 单元查询Karamba3D0(模型=模型视图.模型, 单元编号=panel_9)  # -> 模型, 质量_kg, 面积_m², 体积_m³, 网格, 单元轴线; disabled
ma = MassAddition(Input=单元查询_elemquery_0.质量_kg)  # -> Result, PartialResults; disabled
panel_22 = Panel(单元查询_elemquery_0.网格)  # disabled

# ---- group: CABLES
单元查询_elemquery_0_2 = 单元查询Karamba3D0(模型=模型视图.模型, 单元编号=panel_8)  # -> 模型, 质量_kg, 面积_m², 体积_m³, 网格, 单元轴线; disabled
ma_2 = MassAddition(Input=单元查询_elemquery_0_2.质量_kg)  # -> Result, PartialResults; disabled
panel_23 = Panel(单元查询_elemquery_0_2.网格)  # disabled

# ---- group: DESK
# Bake Geometries
单元查询_elemquery_0_3 = 单元查询Karamba3D0(模型=模型视图.模型, 单元编号=panel_10)  # -> 模型, 质量_kg, 面积_m², 体积_m³, 网格, 单元轴线; disabled
ma_3 = MassAddition(Input=单元查询_elemquery_0_3.质量_kg)  # -> Result, PartialResults; disabled
panel_24 = Panel(单元查询_elemquery_0_3.网格)  # disabled

# ----
panel_25 = Panel(ma_2.Result)  # disabled
panel_26 = Panel(ma_3.Result)  # disabled
panel_27 = Panel(ma.Result)  # disabled
ma_4 = MassAddition(Input=[ma.Result, ma_2.Result, ma_3.Result])  # -> Result, PartialResults; disabled
panel_28 = Panel(ma_4.Result)  # disabled

# ---- group: Outcome of curve and point / 按 Z 高度分组 · 调整 H 改变分界
point_2 = Point([end_points_2.End, end_points_2.Start])
z_分界高度_h_2 = Slider(0.5, range=0..1)
提取_xyz_2 = DeconstructPoint(Point=point_2, System=PlaneXY(0, 0, 0), rhinomcp_alias="z_coordinates", rhinomcp_graph_id="kangaroo_z_split_20261027")  # -> XCoordinate, YCoordinate, ZCoordinate
larger_than_4 = LargerThan(FirstNumber=提取_xyz_2.ZCoordinate, SecondNumber=z_分界高度_h_2)  # -> LargerThan, OrEqualTo
z_高度_2 = Panel(提取_xyz_2.ZCoordinate)
panel_29 = Panel(larger_than_4.LargerThan)
按_z_分组_2 = Dispatch(
    List=point_2,
    DispatchPattern=larger_than_4.LargerThan,
    rhinomcp_alias="split_by_z",
    rhinomcp_graph_id="kangaroo_z_split_20261027")  # -> ListA, ListB
上层点_z_h_2 = Point(按_z_分组_2.ListA)
下层点_z_h_2 = Point(按_z_分组_2.ListB, rhinomcp_alias="lower_points", rhinomcp_graph_id="kangaroo_z_split_20261027")

# ---- group: BAKE!
geo_2 = Geometry(单元查询_elemquery_0_2.网格)  # disabled
geo_3 = Geometry(单元查询_elemquery_0.网格)  # disabled
geo_4 = Geometry(单元查询_elemquery_0_3.网格)  # disabled

# ----
number_slider_17 = Slider(0.05, range=0..0.1)  # disabled
line_3 = Line(单元查询_elemquery_0_2.单元轴线)  # disabled
line_4 = Line(单元查询_elemquery_0.单元轴线)  # disabled
linedim_2 = LineDimension(Line=[line_4, line_3], Text="{0:0.00}", Size=number_slider_17)  # disabled
线转梁_3 = 创建线单元Karamba3D(
    线=structure_3,
    极限距离_m=0.005,
    Y向屈曲长度_m=-1,
    Z向屈曲长度_m=-1,
    侧扭屈曲长度_m=-1,
    弯曲=True,
    转折线最大角度=0.25,
    转多段线容差=0.1,
    转多段线最大边长=0.25,
    新建=True,
    删除=True,
    mode="LineToBeam",
    GuidGeneratorSeed=1341235829)  # -> 单元, 点, 信息; disabled
线转梁_4 = 创建线单元Karamba3D(
    线=all_9_cables,
    极限距离_m=0.005,
    Y向屈曲长度_m=-1,
    Z向屈曲长度_m=-1,
    侧扭屈曲长度_m=-1,
    弯曲=True,
    转折线最大角度=0.25,
    转多段线容差=0.1,
    转多段线最大边长=0.25,
    新建=True,
    删除=True,
    mode="LineToBeam",
    GuidGeneratorSeed=-342783855)  # -> 单元, 点, 信息; disabled

# ---- group: 解析 (Karamba3D)
解析_analyse_2 = 解析Karamba3D(模型=线转梁_3.单元)  # -> 分析结果模型, 最大位移_cm, 合力_kN, 弹性能量变化_kNm; disabled

# ---- group: Analysis Displacement
原始面心_z = DeconstructPoint(Point=top_point, System=PlaneXY(0, 0, 0), rhinomcp_alias="z_before", rhinomcp_graph_id="top_triangle_net_20261027")  # -> XCoordinate, YCoordinate, ZCoordinate
变形后面心_z = DeconstructPoint(Point=上层点_z_h_2, System=PlaneXY(0, 0, 0), rhinomcp_alias="z_after", rhinomcp_graph_id="top_triangle_net_20261027")  # -> XCoordinate, YCoordinate, ZCoordinate
中心下挠_δz = Subtraction(A=原始面心_z.ZCoordinate, B=变形后面心_z.ZCoordinate, rhinomcp_alias="center_sag", rhinomcp_graph_id="top_triangle_net_20261027")
中心下挠_δz_2 = Subtraction(A=原始面心_z.XCoordinate, B=变形后面心_z.XCoordinate, rhinomcp_alias="center_sag", rhinomcp_graph_id="top_triangle_net_20261027")
中心下挠_δz_3 = Subtraction(A=原始面心_z.YCoordinate, B=变形后面心_z.YCoordinate, rhinomcp_alias="center_sag", rhinomcp_graph_id="top_triangle_net_20261027")
panel_30 = Panel(中心下挠_δz_2)
panel_31 = Panel(中心下挠_δz_3)
中心下挠_模型单位 = Panel(中心下挠_δz)

# ---- group: Simulation for maxium load
allowed_maximum_displacement_m = Panel("0.431399")
infeasible_load_penalty = Panel("-1")

# ----
smaller_than = SmallerThan(FirstNumber=raw_maximum_displacement_m, SecondNumber=allowed_maximum_displacement_m)  # -> SmallerThan, OrEqualTo

# ---- group: Simulation for maxium load (continued)
within_limit_and_solver_check = GateAnd(A=smaller_than.SmallerThan, B=both_solvers_stopped_before_limit)
feasible_at_displacement_limit = Panel(within_limit_and_solver_check)
feasible_load_objective = StreamFilter(Gate=within_limit_and_solver_check, Stream0=infeasible_load_penalty, Stream1=load_per_upper_node_p)
objective_maximize_feasible_load_p = Number(feasible_load_objective)
maximize_load_p_per_node = Panel(objective_maximize_feasible_load_p)

# ---- group: Opossum: maximize load + minimize displacement
# Multi-objective setup: Variables: rotation angle and load P. Minimize BOTH objectives: (-P, maximum upper-node displacement). Keep displacement <= 0.431399 m and existing solver checks. Invalid candidates receive (1e6,1e6). Material stiffness is still uncalibrated. Load range currently includes zero.
negate_load = Panel("-1")
penalty_for_both_minimized_objectives = Panel("1000000")
negative_load_p = Multiplication(A=load_per_upper_node_p, B=negate_load)
feasibility_filter = StreamFilter(Gate=within_limit_and_solver_check, Stream0=penalty_for_both_minimized_objectives, Stream1=negative_load_p)
feasibility_filter_2 = StreamFilter(Gate=within_limit_and_solver_check, Stream0=penalty_for_both_minimized_objectives, Stream1=raw_maximum_displacement_m)
obj_1_minimize_negative_load = Number(feasibility_filter)
obj_2_minimize_displacement_m = Number(feasibility_filter_2)
obj_1_minimize_negative_load_2 = Panel(obj_1_minimize_negative_load)
obj_2_minimize_displacement_m_2 = Panel(obj_2_minimize_displacement_m)

# ----
addition = Addition(A=obj_1_minimize_negative_load, B=obj_2_minimize_displacement_m)
number_2 = Number(addition)
panel_32 = Panel(number_2)

# ---- group: Top mesh simulation
interpolate = Interpolate(Vertices=上层点_z_h_2, Degree=1, Periodic=True, KnotStyle=1)  # -> Curve, Length, Domain; disabled
三角面心 = Area(Geometry=interpolate.Curve)  # -> Area, Centroid; disabled
中心荷载幅值_相对 = Slider(0.2, range=0..1)  # disabled
角点_面心种子网格 = DelaunayMesh(
    Points=[上层点_z_h_2, 三角面心.Centroid],
    Plane=PlaneXY(0, 0, 0),
    rhinomcp_alias="seed_triangle",
    rhinomcp_graph_id="top_triangle_net_20261027")  # disabled
向下_z = Negative(Value=中心荷载幅值_相对, rhinomcp_alias="negative", rhinomcp_graph_id="top_triangle_net_20261027")  # disabled
网格边长 = Slider(0.08, range=0.04..0.2)  # disabled
向下集中荷载 = UnitZ(Factor=向下_z)  # disabled
面心节点_load = Load(Point=flatten(三角面心.Centroid), ForceVector=向下集中荷载, Weighting=1)  # disabled
三角网格_含面心节点 = TriRemesh(
    Geometry=flatten(角点_面心种子网格),
    Sharp=True,
    Features=[上层点_z_h_2, 三角面心.Centroid],
    Length=网格边长,
    Iterations=50,
    rhinomcp_alias="remesh",
    rhinomcp_graph_id="top_triangle_net_20261027")  # -> Triangulation, Dual, Creases; disabled
固定三个角点 = Anchor(Point=flatten(上层点_z_h_2), Strength=1000000)  # disabled
输出变形网面 = Show(G=flatten(三角网格_含面心节点.Triangulation), rhinomcp_alias="show_mesh", rhinomcp_graph_id="top_triangle_net_20261027")  # disabled
重置网面_reset = Button(rhinomcp_alias="reset", rhinomcp_graph_id="top_triangle_net_20261027")  # disabled
网面运行_on = BooleanToggle(True)  # disabled

# ---- group: Top mesh simulation / 绳索本构 · 只受拉 / 静长＝初长×比例
初始网格边线 = MeshEdges(Mesh=三角网格_含面心节点.Triangulation, rhinomcp_alias="initial_edges", rhinomcp_graph_id="top_triangle_net_20261027")  # -> NakedEdges, InteriorEdges, NonManifoldEdges; disabled
网边刚度_相对 = Slider(10, range=0.1..100)  # disabled
全部绳段 = Line([初始网格边线.NakedEdges, 初始网格边线.InteriorEdges], rhinomcp_alias="rope_segments", rhinomcp_graph_id="top_triangle_net_20261027")  # disabled
静长比例_预张力 = Slider(1, range=0..1)  # disabled
每段初始长度 = Length(Curve=全部绳段, rhinomcp_alias="initial_lengths", rhinomcp_graph_id="top_triangle_net_20261027")  # disabled
每段绳索静长 = Multiplication(A=每段初始长度, B=静长比例_预张力, rhinomcp_alias="rope_rest_lengths", rhinomcp_graph_id="top_triangle_net_20261027")  # disabled
绳索只受拉 = ClampLength(
    Line=全部绳段,
    LowerLimit=0,
    UpperLimit=每段绳索静长,
    Strength=网边刚度_相对,
    rhinomcp_alias="tension_only",
    rhinomcp_graph_id="top_triangle_net_20261027")  # disabled

# ---- group: Top mesh simulation (continued)
三角绳网求解 = BouncySolver(
    GoalObjects=[固定三个角点, 面心节点_load, 输出变形网面, 绳索只受拉],
    Reset=重置网面_reset,
    Threshold=1e-08,
    Tolerance=0.0001,
    Damping=0.9,
    Iterations=20,
    On=网面运行_on)  # -> I, V, O; disabled
只提取变形网面 = GhPythonScript(G=flatten(三角绳网求解.O), rhinomcp_alias="mesh_type_filter", rhinomcp_graph_id="top_triangle_net_20261027")  # -> out, M; inputs G: list; disabled
#   port G: Kangaroo goal outputs, including nulls, lines and meshes
# ---------- 只提取变形网面: Python ----------
import Rhino.Geometry as rg
M = []
for item in G or []:
    if item is None:
        continue
    if hasattr(item, 'ScriptVariable'):
        item = item.ScriptVariable()
    if isinstance(item, rg.Mesh):
        M.append(item)
# ---------- end 只提取变形网面 ----------
变形后的三角绳网 = Mesh(只提取变形网面.M, rhinomcp_alias="deformed_mesh", rhinomcp_graph_id="top_triangle_net_20261027")  # disabled
变形绳网边线 = MeshEdges(Mesh=变形后的三角绳网, rhinomcp_alias="deformed_edges", rhinomcp_graph_id="top_triangle_net_20261027")  # -> NakedEdges, InteriorEdges, NonManifoldEdges; disabled

# ---- group: Analysis 中心下挠 ΔZ · 同一网格节点前后对比
初始网格节点 = DeconstructMesh(Mesh=三角网格_含面心节点.Triangulation, rhinomcp_alias="rest_vertices", rhinomcp_graph_id="top_triangle_net_20261027")  # -> Vertices, Faces, Colours, Normals; disabled
变形后的节点 = DeconstructMesh(Mesh=变形后的三角绳网, rhinomcp_alias="solved_vertices", rhinomcp_graph_id="top_triangle_net_20261027")  # -> Vertices, Faces, Colours, Normals; disabled
找到面心节点编号 = ClosestPoint(Point=三角面心.Centroid, Cloud=初始网格节点.Vertices, rhinomcp_alias="center_index", rhinomcp_graph_id="top_triangle_net_20261027")  # -> ClosestPoint, CPIndex, Distance; disabled
同一个面心节点 = ListItem(
    List=变形后的节点.Vertices,
    Index=找到面心节点编号.CPIndex,
    Wrap=True,
    rhinomcp_alias="solved_center",
    rhinomcp_graph_id="top_triangle_net_20261027")  # disabled
原始面心_z_2 = DeconstructPoint(Point=三角面心.Centroid, System=PlaneXY(0, 0, 0), rhinomcp_alias="z_before", rhinomcp_graph_id="top_triangle_net_20261027")  # -> XCoordinate, YCoordinate, ZCoordinate; disabled
变形后面心_z_2 = DeconstructPoint(Point=同一个面心节点, System=PlaneXY(0, 0, 0), rhinomcp_alias="z_after", rhinomcp_graph_id="top_triangle_net_20261027")  # -> XCoordinate, YCoordinate, ZCoordinate; disabled
中心下挠_δz_4 = Subtraction(
    A=原始面心_z_2.ZCoordinate,
    B=变形后面心_z_2.ZCoordinate,
    rhinomcp_alias="center_sag",
    rhinomcp_graph_id="top_triangle_net_20261027")  # disabled
中心下挠_模型单位_2 = Panel(中心下挠_δz_4)  # disabled

# ==== cluster DeskGeometry
F = ClusterInput()
B = ClusterInput()
D = ClusterInput()
R = ClusterInput()
mres = ClusterInput()
t = ClusterInput()
geo = ClusterInput()
geo_2 = Geometry(geo)
item = ListItem(List=geo_2, Index=0, Wrap=True)  # -> Item, Item1, Item2
ln = Line(StartPoint=item.Item, EndPoint=item.Item1)
curvepoint = PointOnCurve(ln, parameter=0.5)
Y = UnitY(Factor=F)
move = Move(Geometry=curvepoint, Motion=expr("-x", Y))  # -> Geometry, Transform
circle = Circle3Pt(PointA=item.Item, PointB=item.Item1, PointC=move.Geometry)  # -> Circle, Plane, Radius
panel = Panel(circle.Radius)
crv_cp = CurveClosestPoint(Point=curvepoint, Curve=circle.Circle)  # -> Point, Parameter, Distance
seam = Seam(Curve=reparameterize(circle.Circle), Seam=t)
ln_2 = Line(StartPoint=crv_cp.Point, EndPoint=item.Item2)
len = Length(Curve=ln_2)
addition = Addition(A=len, B=B)
offset = OffsetCurve(Curve=seam, Distance=expr("-x", addition), Corners=1)
offset_2 = OffsetCurve(Curve=seam, Distance=D, Corners=1)
rulesrf = RuledSurface(CurveA=offset, CurveB=offset_2)
sdivide = DivideSurface(Surface=rulesrf, UCount=Slider(8, range=0..10), VCount=1)  # -> Points, Normals, Parameters
flip = FlipMatrix(Data=sdivide.Points)
bang = ExplodeTree(Data=flip)  # -> Branch0, Branch1
ln_3 = Line(StartPoint=bang.Branch0, EndPoint=bang.Branch1)
len_2 = Length(Curve=ln_3)
srfsplit = SurfaceSplit(Surface=rulesrf, Curves=ln_3)
panel_2 = Panel(len_2)
item_2 = ListItem(List=srfsplit, Index=Slider(10, range=0..10), Wrap=True)
area = Area(Geometry=item_2)  # -> Area, Centroid
panel_3 = Panel(area.Area)
fillet = Fillet(Curve=item_2, Radius=R)

# ---- group: Mesh Breps (Karamba3D)
mesh_breps = MeshBrepsKaramba3D(
    Brep=fillet,
    InclusionPoints=geo_2,
    MeshResolution=mres,
    EdgeRefinementFactor=0.67,
    PointReduction=False,
    SmoothingStepSize=0,
    SmoothingIterations=5)  # -> Mesh, Info

# ----
medges = MeshEdges(Mesh=mesh_breps.Mesh)  # -> NakedEdges, InteriorEdges, NonManifoldEdges
mesh = ClusterOutput(mesh_breps.Mesh)
L = ClusterOutput(ln_3)
C = ClusterOutput(offset)
C_2 = ClusterOutput(offset_2)
