# Grasshopper definition tensegritydemo 3prism_2026.ghx (Grasshopper 1.0.8)
# plug-ins: Karamba3D, Opossum2_0_Proto_B, Bifocals, Opossum2_0_Proto_A

# ---- group: Top
unit_z = UnitZ(Factor=Slider(1.2, range=0..10))
top_radius = Slider(0.5, range=0.5..1.5)
xy_plane = XYPlane(Origin=unit_z)
polygon = Polygon(Plane=xy_plane, Radius=top_radius, Segments=Slider(3, range=0..10), FilletRadius=0)  # -> Polygon, Length

# ---- group: Bottom
unit_z_2 = UnitZ(Factor=Slider(0, range=0..10))
bottom_radius = Slider(0.5, range=0.5..1.5)
xy_plane_2 = XYPlane(Origin=unit_z_2)
polygon_2 = Polygon(Plane=xy_plane_2, Radius=bottom_radius, Segments=Slider(3, range=0..10), FilletRadius=0)  # -> Polygon, Length

# ---- group: Rotation
rotate_angle = Slider(184.134, range=0..360)
rotate = Rotate(Geometry=polygon.Polygon, Angle=degrees(rotate_angle), Plane=PlaneXY(0, 0, 0))  # -> Geometry, Transform

# ---- group: Bottom point
curve = Curve(polygon_2.Polygon)
divide_curve = DivideCurve(Curve=curve, Count=Slider(3, range=0..10), Kinks=False)  # -> Points, Tangents, Parameters
explode_object = ExplodeObject(Object=curve, Recursive=False)
list_item = ListItem(List=divide_curve.Points, Index=0, Wrap=True)  # -> Item, Item1, Item2

# ---- group: Top point
curve_2 = Curve(rotate.Geometry)
divide_curve_2 = DivideCurve(Curve=curve_2, Count=Slider(3, range=0..10), Kinks=False)  # -> Points, Tangents, Parameters
explode_object_2 = ExplodeObject(Object=curve_2, Recursive=False)
list_item_2 = ListItem(List=divide_curve_2.Points, Index=0, Wrap=True)  # -> Item, Item1, Item2

# ---- group: Structure
polyline = PolyLine(Vertices=[list_item.Item2, list_item_2.Item2], Closed=False)
polyline_2 = PolyLine(Vertices=[list_item.Item1, list_item_2.Item1], Closed=False)
polyline_3 = PolyLine(Vertices=[list_item_2.Item, list_item.Item], Closed=False)
structure = Curve([polyline_3, polyline_2, polyline])

# ---- group: Cable
polyline_4 = PolyLine(Vertices=[list_item_2.Item2, list_item.Item], Closed=False)
polyline_5 = PolyLine(Vertices=[list_item_2.Item1, list_item.Item2], Closed=False)
polyline_6 = PolyLine(Vertices=[list_item_2.Item, list_item.Item1], Closed=False)
structure_2 = Curve([polyline_6, polyline_5, polyline_4, explode_object_2, explode_object])

# ----
struts = Curve(structure)
cables = Curve(structure_2)

bottom_point = Point(divide_curve.Points)
top_point = Point(divide_curve_2.Points)
各向同性 = 材料属性Karamba3D(
    截面系列="Steel",
    名称="PE",
    弹性模量_kN_cm²=Slider(100, range=0..100),
    面内剪切模量_kN_cm²=Slider(40, range=0..100),
    横向剪切模量_kN_cm²=Slider(3, range=0..10),
    容重_kN_m³=Slider(950, range=0..1000),
    热膨胀系数_1="200e-06",
    抗拉强度_kN_cm²=Slider(50, range=0..50),
    抗压强度_kN_cm²=Slider(1.007, range=0..10),
    强度假设="MISES",
    mode="Isotrop")

# ---- group: CABLES
截面范围选择器 = 截面范围选择器Karamba3D(最大高度_cm=-1, 最大宽度_cm=-1, menu=[dropdown(1), dropdown(2), dropdown(4), dropdown(0)])
panel = Panel(截面范围选择器)
panel_2 = Panel("""0
1
2""")
panel_3 = Panel("""3
4
6""")
cull_i = CullIndex(List=截面范围选择器, Indices=panel_2, Wrap=True)
item = ListItem(List=截面范围选择器, Index=panel_3, Wrap=True)

# ----
number_slider = Slider(1, range=0..1)

# ---- group: Kangeroo simulation / Character of Cable / Cable pre-tension
slider = Slider(0.861, range=0..1)

# ---- group: Kangeroo simulation / Character of Cable
divide_domain = DivideDomain(Domain=Domain(0, 1), Count=10)
panel_4 = Panel(divide_domain)
sub_curve = SubCurve(BaseCurve=reparameterize(graft(cables)), Domain=divide_domain)
subtraction = Subtraction(A="1", B=slider)
length = Length(Curve=sub_curve)
line = Line(sub_curve)
cable_lenght = Panel(line)
multiplication = Multiplication(A=length, B=subtraction)
panel_5 = Panel(multiplication)
length_line = LengthLine(Line=line, Length=multiplication, Strength=10)

# ---- group: CABLE PRETENSION
number_slider_2 = Slider(0.5, range=0..100)

# ---- group: Kangeroo simulation / kN
load_per_upper_node_p = Slider(0.558, range=0..1)

# ---- group: 荷载 (Karamba3D)
重力 = 荷载Karamba3D(向量=Vector(0, 0, -1), 荷载工况="LC0", mode="Gravity")

# ---- group: Kangeroo simulation
unit_z_3 = UnitZ(Factor=expr("-x", load_per_upper_node_p))
load = Load(Point=top_point, ForceVector=unit_z_3, Weighting=1)
length_line_2 = LengthLine(Line=struts, Strength=10)
vector_display = VectorDisplay(Anchor=top_point, Vector=unit_z_3)
anchor = Anchor(Point=bottom_point, Strength=10000)
solver_threshold = Panel("0.0000000000000001")
zombiesolver = ZombieSolver(
    GoalObjects=[length_line, anchor, length_line_2, load],
    Threshold=solver_threshold,
    Tolerance=0.0001,
    MaxIterations=50000)  # -> I, V, O

boolean_toggle = BooleanToggle(False)
trigger = Timer(Interval=1, TimerInterval=5)

# ---- group: Opossum
performance_explorer = PerformanceExplorer()
opossum = Opossum(
    OpossumData_NumberOfObjectives=2,
    OpossumData_OptimizationType=0,
    OpossumData_ResultSerializationStatus=1,
    OpossumData_ObjectiveList=[[1000000, 1000000], [-0.025, 0.01333730451], [-0.5, 0.246456006], [1000000, 1000000], [-0.001, 0.0005259916228], [-0.445, 0.2132930544]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],
    OpossumData_ParameterList=["0.733207,1.792452", "0.024706,350.028078", "0.500000,180.000000", "0.996099,358.653255", "0.001239,2.274727", "0.445284,215.002209"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],
    OpossumData_objective=[obj_1_minimize_negative_load, obj_2_minimize_displacement_m],
    OpossumData_simulator=[zombie_unloaded, zombie_loaded],
    OpossumData_variable=[load_per_upper_node_p, rotate_angle])
galapagos = Galapagos(fitness=galapagos_fitness_minimize, gene=[rotate_angle, load_per_upper_node_p])
fitness_landscape = FitnessLandscape(Count=-1, ColourMode=1, ContourMode=2, Remap=False)
gene_pool = GenePool(Decimals=2, Maximum=100, Minimum=0, Value=[50, 50, 50, 50.37, 50, 50, 50, 50, 50, 50])

# ----
trigger_2 = Trigger(Interval=-1000, TimerInterval=1000, Target=opossum)

# ---- group: Outcome of curve and point
geometry = Geometry(zombiesolver.O)
length_2 = Length(Curve=geometry)
larger_than = LargerThan(FirstNumber=length_2, SecondNumber=Slider(1, range=0..10))  # -> LargerThan, OrEqualTo
dispatch = Dispatch(List=geometry, DispatchPattern=larger_than.LargerThan)  # -> ListA, ListB
geometry_2 = Geometry(dispatch.ListA)
geometry_3 = Geometry(dispatch.ListB)
end_points = EndPoints(Curve=geometry_2)  # -> Start, End
pipe = Pipe(Curve=geometry_2, Radius=Slider(0.03, range=0..0.5), Caps=0)  # disabled

# ---- group: Outcome of curve and point / Native components: 90 segments to 9 cables
clean = CleanTree(RemoveNulls=True, RemoveInvalid=True, RemoveEmpty=False, Tree=geometry_3)
lng = ListLength(List=divide_domain)
partition = PartitionList(List=flatten(clean), Size=lng)
join = JoinCurves(Curves=partition, Preserve=False)
end = EndPoints(Curve=join)  # -> Start, End
ln = Line(StartPoint=end.Start, EndPoint=end.End)
all_9_cables = Line(flatten(ln))
split = SplitList(List=all_9_cables, Index=3)  # -> ListA, ListB
split_2 = SplitList(List=split.ListB, Index=3)  # -> ListA, ListB
connecting_3_cables = Line(split.ListA)
upper_triangle_3_cables = Line(split_2.ListA)
lower_triangle_3_cables = Line(split_2.ListB)

# ----
cables_2 = Geometry(all_9_cables)
struts_2 = Geometry(geometry_2)
# Input
panel_6 = Panel("strut")

explode = Explode(Curve=cables_2, Recursive=True)  # -> Segments, Vertices
crv = Curve(explode.Segments)
line_2 = Line(crv)

linedim = LineDimension(Line=struts_2, Text="{0:0.00}", Size=Slider(0.05, range=0..0.1))

end_2 = EndPoints(Curve=struts_2)  # -> Start, End
支撑件 = 支座Karamba3D(位置序号=end_2.Start, Ct_kN_m=Vector(0, 0, 0), Cr_kNm_rad=Vector(0, 0, 0), menu=[buttons(off, off, on, off, off, off)])

# ---- group: NEW DESK
pline = PolyLine(Vertices=end_2.End, Closed=invert(False))
geo = Geometry(<curve referenced from the Rhino model>)
area = Area(Geometry=pline)  # -> Area, Centroid
area_2 = Area(Geometry=geo)  # -> Area, Centroid
vec2pt = Vector2Pt(PointA=area_2.Centroid, PointB=area.Centroid, Unitize=False)  # -> Vector, Length
move = Move(Geometry=geo, Motion=vec2pt.Vector)  # -> Geometry, Transform

# ---- group: JOINTS
梁单元_释放 = 梁单元释放Karamba3D(
    梁单元编号=panel_6,
    起始节点Ct_kN_m=Vector(0, 0, 0),
    起始节点Cr_kNm_rad=Vector(0, 0, 0),
    终端节点Ct_kN_m=Vector(0, 0, 0),
    终端节点Cr_kNm_rad=Vector(0, 0, 0),
    menu=[buttons(off, off, off, off, off, off), buttons(on, on, on, on, on, on)])

# ---- group: GRAVITY LOAD
重力_2 = 荷载Karamba3D(向量=Vector(0, 0, -1), 荷载工况="LC0", mode="Gravity")

# ---- group: CABLE PRETENSION / 荷载 (Karamba3D)
初始应变 = 荷载Karamba3D(初始应变=number_slider_2, 单元编号="cable", 荷载工况="LC0", mode="InitialStrain")

# ---- group: CABLES
线转梁 = 创建线单元Karamba3D(
    线=line_2,
    编号="cable",
    截面=截面范围选择器,
    极限距离_m=0.005,
    Y向屈曲长度_m=-1,
    Z向屈曲长度_m=-1,
    侧扭屈曲长度_m=-1,
    弯曲=True,
    转折线最大角度=0.03,
    转多段线容差=0.01,
    转多段线最大边长=0.25,
    新建=True,
    删除=True,
    mode="LineToBeam",
    GuidGeneratorSeed=-1518674337)  # -> 单元, 点, 信息

# ----
ext_offest = Slider(0.249, range=0..1)
int_offest = Slider(0.191, range=0..1)
fillet_radius = Slider(0.06, range=0..1)
desk_geometry = DeskGeometry(
    geo=end_2.End,
    F=Slider(0.053183, range=0..0.1),
    t=Slider(0.515, range=0..1),
    D=ext_offest,
    B=int_offest,
    R=fillet_radius,
    mres=Slider(0.38, range=0..1))  # -> C, C_2, L, mesh

# ---- group: Brep网格划分 (Karamba3D)
brep网格划分 = Brep网格划分Karamba3D(Brep=move.Geometry, 相交点=end_2.End, 网格大小=1, 边缘细分系数=Slider(0.1, range=0..1), 点缩减=False, 平滑步长=0, 平滑迭代次数=5)  # -> 网格, 信息

# ----
材料选择 = 材料选择集Karamba3D(单元ID=panel_6, menu=[dropdown(1), dropdown(2), dropdown(2)])
series = Series(Start=2, Step=0.5, Count=Slider(23, range=0..100))
圆形截面 = 截面Karamba3D(截面系列名称="DefaultCroSec", 单元ID=panel_6, 材料=材料选择, 直径_cm=series, 壁厚_cm=expr("x/2", series), mode="Circular Hollow")
panel_7 = Panel(series)
panel_8 = Panel("""0
1""")
panel_9 = Panel(圆形截面)

# ---- group: DESK
材料选择_2 = 材料选择集Karamba3D(单元ID="desk", menu=[dropdown(1), dropdown(2), dropdown(2)])
series_2 = Series(Start=0.5, Step=0.5, Count=Slider(12, range=0..100))
壳体截面 = 截面Karamba3D(截面系列名称="DefaultCroSec", 单元ID="desk", 材料=材料选择_2, 高度_cm=series_2, mode="Shell - Const")
panel_10 = Panel(series_2)
panel_11 = Panel(壳体截面)

area_3 = Area(Geometry=brep网格划分.网格)  # -> Area, Centroid
panel_12 = Panel(area_3.Area)
网格转壳 = 创建曲面单元Karamba3D(网格=brep网格划分.网格, 编号="desk", 截面=壳体截面, 极限距离_m=0.005, 弯曲=True, mode="MeshToShell", GuidGeneratorSeed=782702785)  # -> 单元, 点, 信息

# ----
cull_i_2 = CullIndex(List=圆形截面, Indices=panel_8, Wrap=True)

# ---- group: LIVE LOAD
number_slider_3 = Slider(0.8, range=0..1)  # "KN/m2"
Z = UnitZ(Factor=expr("-x", number_slider_3))
vdis = VectorDisplay(Anchor=网格转壳.点, Vector=Z)

# ----
线转梁_2 = 创建线单元Karamba3D(
    线=struts_2,
    编号=panel_6,
    截面=圆形截面,
    极限距离_m=0.005,
    Y向屈曲长度_m=-1,
    Z向屈曲长度_m=-1,
    侧扭屈曲长度_m=-1,
    弯曲=True,
    转折线最大角度=0.03,
    转多段线容差=0.01,
    转多段线最大边长=0.25,
    新建=True,
    删除=True,
    mode="LineToBeam",
    GuidGeneratorSeed=-1411999891)  # -> 单元, 点, 信息

# ---- group: LIVE LOAD / 荷载 (Karamba3D)
网格荷载常量 = 荷载Karamba3D(向量=Z, 网格=brep网格划分.网格, 单元编号="desk", 荷载工况="LC0", mode="MeshLoad -Const.", menu=[buttons(on, off, off), buttons(on, on)])

# ---- group: ANALYZE & OPTIMIZE CROSS SECTION / 模型构建 (Karamba3D)
模型构建 = 模型构建Karamba3D(
    单元=flatten([线转梁_2.单元, 线转梁.单元, 网格转壳.单元]),
    支座=flatten(支撑件),
    荷载=flatten([网格荷载常量, 重力_2, 初始应变]),
    梁端释放=flatten(梁单元_释放),
    极限距离_m=0.005)  # -> 模型, 信息, 质量_kg, 重心, 荷载工况名称

# ---- group: ANALYZE & OPTIMIZE CROSS SECTION / 截面优化(Karamba3D)
优化截面 = 截面优化Karamba3D(
    模型=模型构建.模型,
    单元编号=flatten(panel_6),
    截面=flatten(cull_i_2),
    最大利用率=1,
    最大位移_cm=-1,
    MaximumVirtualWork_kNcm=0.01,
    利用率迭代次数=5,
    位移迭代次数=5,
    NumberOfDisplacementIncrementsPerIteration=2,
    DisplacementTolerance=0.01,
    采样点数=3,
    弹性设计=True,
    材料安全系数gammaM0=1,
    材料安全系数gammaM1=1.1,
    侧移框架=True)  # -> 优化后的模型, 信息, 质量_kg, 最大位移_cm, 弹性能量变化_kNm, 最大利用率视图不足截面, 最大位移视图限值截面

优化截面_2 = 截面优化Karamba3D(
    模型=优化截面.优化后的模型,
    单元编号="cable",
    截面=cull_i,
    最大利用率=1,
    最大位移_cm=-1,
    MaximumVirtualWork_kNcm=0.01,
    利用率迭代次数=5,
    位移迭代次数=5,
    NumberOfDisplacementIncrementsPerIteration=2,
    DisplacementTolerance=0.01,
    采样点数=3,
    弹性设计=True,
    材料安全系数gammaM0=1,
    材料安全系数gammaM1=1.1,
    侧移框架=True)  # -> 优化后的模型, 信息, 质量_kg, 最大位移_cm, 弹性能量变化_kNm, 最大利用率视图不足截面, 最大位移视图限值截面

优化截面_3 = 截面优化Karamba3D(
    模型=优化截面_2.优化后的模型,
    单元编号="desk",
    截面=壳体截面,
    最大利用率=1,
    最大位移_cm=-1,
    MaximumVirtualWork_kNcm=0.01,
    利用率迭代次数=5,
    位移迭代次数=5,
    NumberOfDisplacementIncrementsPerIteration=2,
    DisplacementTolerance=0.01,
    采样点数=3,
    弹性设计=True,
    材料安全系数gammaM0=1,
    材料安全系数gammaM1=1.1,
    侧移框架=True)  # -> 优化后的模型, 信息, 质量_kg, 最大位移_cm, 弹性能量变化_kNm, 最大利用率视图不足截面, 最大位移视图限值截面

# ---- group: ANALYZE & OPTIMIZE CROSS SECTION / 解析 (Karamba3D)
解析_analyse = 解析Karamba3D(模型=[优化截面_3.优化后的模型, 优化截面.优化后的模型], 荷载工况="LC0")  # -> 分析结果模型, 最大位移_cm, 合力_kN, 弹性能量变化_kNm

# ----
# Finite Element Analysis
number = Number(解析_analyse.最大位移_cm)

# ---- group: ANALYZE & OPTIMIZE CROSS SECTION
panel_13 = Panel(模型构建.模型)
panel_14 = Panel(解析_analyse.合力_kN)
panel_15 = Panel(number)

# ---- group: 模型视图 (Karamba3D)
模型视图 = 模型视图Karamba3D(
    模型=解析_analyse.分析结果模型,
    menu=[checkbox(on), slider(0), checkbox(off), slider(1), checkbox(off), slider(0.16), slider(0.16), checkbox(off), slider(0.08), checkbox(off), slider(1), checkbox(off), slider(1), checkbox(off), checkbox(off), slider(1), slider(100), slider(0), buttons(on, off), slider(0.11), slider(0.01), checkbox(off), checkbox(off), checkbox(off), checkbox(on), checkbox(off), checkbox(off), checkbox(off), buttons(off, off, off), buttons(on, on), dropdown(1), dropdown(0)])  # -> 模型, 变形后的网格, 变形后的轴线, 变形后的模型, 最大变形

# ---- group: BEAMS / 梁单元视图 (Karamba3D)
梁视图 = 梁单元视图Karamba3D(
    模型=模型视图.模型,
    menu=[checkbox(off), checkbox(off), slider(0.04), slider(0.04), checkbox(off), checkbox(off), checkbox(off), checkbox(on), checkbox(off), checkbox(off), buttons(off, on, off, off, off, off, off, off, off, off, off, off, off, off, off, off, off, off, off, off), slider(1), slider(3)])  # -> 模型, 渲染梁单元的网格, 变形后的梁单元轴线, 图例颜色, 图例标签

# ---- group: SHELL / 壳单元视图 (Karamba3D)
壳体视图 = 壳单元视图Karamba3D(
    模型=模型视图.模型,
    层序号=0,
    menu=[checkbox(off), slider(1), buttons(on, off, off, off, off, off, off), slider(0), checkbox(off), slider(1)])  # -> 模型, 渲染壳单元的网格, 图例颜色, 图例标签

# ---- group: BEAMS
梁的力 = 截面力Karamba3D(分析结果模型=梁视图.模型, Ts=[0, 1])  # -> 模型, 轴力_kN, 剪力Vz_kN, 剪力Vy_kN, 扭矩Mt_kNm, 弯矩My_kNm, 弯矩Mz_kNm, 荷载工况序号
legend = LegendKaramba3D(
    Colors=梁视图.图例颜色,
    Tags=梁视图.图例标签,
    Scale=0.8,
    Textsize=30,
    Legend_HasHeader=False,
    Legend_Justification=2,
    Legend_Position=3)
legend_2 = Legend(Colour=梁视图.图例颜色, Tags=梁视图.图例标签, LegendType=1)
panel_16 = Panel(梁的力.轴力_kN)

# ---- group: SHELL
legend_3 = LegendKaramba3D(
    Colors=壳体视图.图例颜色,
    Tags=壳体视图.图例标签,
    Scale=0.8,
    Textsize=30,
    Legend_HasHeader=False,
    Legend_Justification=2,
    Legend_Position=2)
legend_4 = Legend(Colour=壳体视图.图例颜色, Tags=壳体视图.图例标签, LegendType=1)

# ---- group: Outcome of curve and point / 按 Z 高度分组 · 调整 H 改变分界
point = Point([end_points.End, end_points.Start])
z_分界高度_h = Slider(0.5, range=0..1)
提取_xyz = DeconstructPoint(Point=point, System=PlaneXY(0, 0, 0), rhinomcp_alias="z_coordinates", rhinomcp_graph_id="kangaroo_z_split_20261027")  # -> XCoordinate, YCoordinate, ZCoordinate
larger_than_2 = LargerThan(FirstNumber=提取_xyz.ZCoordinate, SecondNumber=z_分界高度_h)  # -> LargerThan, OrEqualTo
z_高度 = Panel(提取_xyz.ZCoordinate)
panel_17 = Panel(larger_than_2.LargerThan)
按_z_分组 = Dispatch(
    List=point,
    DispatchPattern=larger_than_2.LargerThan,
    rhinomcp_alias="split_by_z",
    rhinomcp_graph_id="kangaroo_z_split_20261027")  # -> ListA, ListB
上层点_z_h = Point(按_z_分组.ListA)
下层点_z_h = Point(按_z_分组.ListB, rhinomcp_alias="lower_points", rhinomcp_graph_id="kangaroo_z_split_20261027")

# ---- group: STRUTS
单元查询_elemquery_0 = 单元查询Karamba3D0(模型=模型视图.模型, 单元编号=panel_6)  # -> 模型, 质量_kg, 面积_m², 体积_m³, 网格, 单元轴线
ma = MassAddition(Input=单元查询_elemquery_0.质量_kg)  # -> Result, PartialResults
panel_18 = Panel(单元查询_elemquery_0.网格)

# ---- group: CABLES
单元查询_elemquery_0_2 = 单元查询Karamba3D0(模型=模型视图.模型, 单元编号="cable")  # -> 模型, 质量_kg, 面积_m², 体积_m³, 网格, 单元轴线
ma_2 = MassAddition(Input=单元查询_elemquery_0_2.质量_kg)  # -> Result, PartialResults
panel_19 = Panel(单元查询_elemquery_0_2.网格)

# ---- group: DESK
# Bake Geometries
单元查询_elemquery_0_3 = 单元查询Karamba3D0(模型=模型视图.模型, 单元编号="desk")  # -> 模型, 质量_kg, 面积_m², 体积_m³, 网格, 单元轴线
ma_3 = MassAddition(Input=单元查询_elemquery_0_3.质量_kg)  # -> Result, PartialResults
panel_20 = Panel(单元查询_elemquery_0_3.网格)

# ----
panel_21 = Panel(ma_2.Result)
panel_22 = Panel(ma_3.Result)
panel_23 = Panel(ma.Result)
ma_4 = MassAddition(Input=[ma.Result, ma_2.Result, ma_3.Result])  # -> Result, PartialResults
panel_24 = Panel(ma_4.Result)

# ---- group: BAKE!
geo_2 = Geometry(单元查询_elemquery_0_2.网格)
geo_3 = Geometry(单元查询_elemquery_0.网格)
geo_4 = Geometry(单元查询_elemquery_0_3.网格)

# ----
line_3 = Line(单元查询_elemquery_0_2.单元轴线)
line_4 = Line(单元查询_elemquery_0.单元轴线)
linedim_2 = LineDimension(Line=[line_4, line_3], Text="{0:0.00}", Size=Slider(0.05, range=0..0.1))

# ---- group: Analysis Displacement
原始面心_z = DeconstructPoint(Point=top_point, System=PlaneXY(0, 0, 0), rhinomcp_alias="z_before", rhinomcp_graph_id="top_triangle_net_20261027")  # -> XCoordinate, YCoordinate, ZCoordinate
变形后面心_z = DeconstructPoint(Point=上层点_z_h, System=PlaneXY(0, 0, 0), rhinomcp_alias="z_after", rhinomcp_graph_id="top_triangle_net_20261027")  # -> XCoordinate, YCoordinate, ZCoordinate
中心下挠_δz = Subtraction(A=原始面心_z.ZCoordinate, B=变形后面心_z.ZCoordinate, rhinomcp_alias="center_sag", rhinomcp_graph_id="top_triangle_net_20261027")
中心下挠_δz_2 = Subtraction(A=原始面心_z.XCoordinate, B=变形后面心_z.XCoordinate, rhinomcp_alias="center_sag", rhinomcp_graph_id="top_triangle_net_20261027")
中心下挠_δz_3 = Subtraction(A=原始面心_z.YCoordinate, B=变形后面心_z.YCoordinate, rhinomcp_alias="center_sag", rhinomcp_graph_id="top_triangle_net_20261027")
panel_25 = Panel(中心下挠_δz_2)
panel_26 = Panel(中心下挠_δz_3)
中心下挠_模型单位 = Panel(中心下挠_δz)

# ---- group: Opossum objective - loaded versus unloaded equilibrium
# Read me: Minimize OBJECTIVE. Compare same-angle equilibria with and without external load. Prestress retained in both. Units: model m. Iteration-limit cases receive 1e6. This is a displacement objective, not a stability or strength certificate. Last 3 solver outputs are tracked Show points: keep Show last.
length_line_3 = LengthLine(Line=line, Length=multiplication, Strength=10)
anchor_2 = Anchor(Point=bottom_point, Strength=10000)
length_line_4 = LengthLine(Line=struts, Strength=10)
length_line_5 = LengthLine(Line=line, Length=multiplication, Strength=10)
anchor_3 = Anchor(Point=bottom_point, Strength=10000)
length_line_6 = LengthLine(Line=struts, Strength=10)
load_2 = Load(Point=top_point, ForceVector=unit_z_3, Weighting=1)
solver_threshold_2 = Panel("0.0000000000000001")
show_upper_3_nodes = Show(G=top_point)
show_upper_3_nodes_2 = Show(G=top_point)
ordered_goals_show_last = Merge(Data1=flatten(length_line_3), Data2=flatten(anchor_2), Data3=flatten(length_line_4), Data4=flatten(show_upper_3_nodes))
ordered_goals_show_last_2 = Merge(
    Data1=flatten(length_line_5),
    Data2=flatten(anchor_3),
    Data3=flatten(length_line_6),
    Data4=flatten(load_2),
    Data5=flatten(show_upper_3_nodes_2))
maximum_iterations = Panel("10000")
zombie_loaded = ZombieSolver(
    GoalObjects=flatten(ordered_goals_show_last_2),
    Threshold=solver_threshold_2,
    Tolerance=1e-06,
    MaxIterations=maximum_iterations)  # -> I, V, O
zombie_unloaded = ZombieSolver(
    GoalObjects=flatten(ordered_goals_show_last),
    Threshold=solver_threshold_2,
    Tolerance=1e-06,
    MaxIterations=maximum_iterations)  # -> I, V, O
loaded_iterations = Panel(zombie_loaded.I)
unloaded_iterations = Panel(zombie_unloaded.I)
unloaded_stopped_before_limit = SmallerThan(FirstNumber=zombie_unloaded.I, SecondNumber=maximum_iterations)  # -> SmallerThan, OrEqualTo
loaded_stopped_before_limit = SmallerThan(FirstNumber=zombie_loaded.I, SecondNumber=maximum_iterations)  # -> SmallerThan, OrEqualTo
last_3_outputs_tracked_upper_nodes = Panel("""-3
-2
-1""")
track_upper_3_loaded = ListItem(List=flatten(zombie_loaded.O), Index=last_3_outputs_tracked_upper_nodes, Wrap=True)
track_upper_3_unloaded = ListItem(List=flatten(zombie_unloaded.O), Index=last_3_outputs_tracked_upper_nodes, Wrap=True)
loaded_upper_nodes = Point(track_upper_3_loaded)
unloaded_upper_nodes = Point(track_upper_3_unloaded)
deconstruct = Deconstruct(Point=loaded_upper_nodes)  # -> XComponent, YComponent, ZComponent
both_solvers_stopped_before_limit = GateAnd(A=unloaded_stopped_before_limit.SmallerThan, B=loaded_stopped_before_limit.SmallerThan)
number_2 = Number(deconstruct.ZComponent)
larger_than_3 = LargerThan(FirstNumber=number_2, SecondNumber="0")  # -> LargerThan, OrEqualTo
gate_and = GateAnd(A=larger_than_3.LargerThan, B=loaded_upper_nodes)
panel_27 = Panel("1")
iteration_limit_penalty = Panel("1000000")

# ----
reject_iteration_limit_results = StreamFilter(Gate=gate_and, Stream0=panel_27, Stream1=loaded_upper_nodes)
panel_28 = Panel(gate_and)

# ---- group: Opossum objective - loaded versus unloaded equilibrium (continued)
upper_node_displacements = Distance(PointA=unloaded_upper_nodes, PointB=reject_iteration_limit_results)
bnd = Bounds(Numbers=flatten(upper_node_displacements))
displacement_of_3_nodes_m = Panel(upper_node_displacements)
dedomain = DeconstructDomain(Domain=bnd)  # -> Start, End
raw_maximum_displacement_m = Number(dedomain.End)
reject_iteration_limit_results_2 = StreamFilter(Gate=both_solvers_stopped_before_limit, Stream0=iteration_limit_penalty, Stream1=raw_maximum_displacement_m)
panel_29 = Panel(raw_maximum_displacement_m)
objective_minimize_upper_displacement = Number(reject_iteration_limit_results_2)
objective_minimize = Panel(objective_minimize_upper_displacement)

# ---- group: Simulation for maxium load
allowed_maximum_displacement_m = Panel("0")
larger_than_4 = LargerThan(FirstNumber=raw_maximum_displacement_m, SecondNumber=allowed_maximum_displacement_m)  # -> LargerThan, OrEqualTo
infeasible_load_penalty = Panel("-1")
within_limit_and_solver_check = GateAnd(A=larger_than_4.LargerThan, B=both_solvers_stopped_before_limit)
feasible_at_displacement_limit = Panel(within_limit_and_solver_check)
feasible_load_objective = StreamFilter(Gate=within_limit_and_solver_check, Stream0=infeasible_load_penalty, Stream1=load_per_upper_node_p)
objective_maximize_feasible_load_p = Number(feasible_load_objective)
maximum_load_test = Panel("这里如果要测试最大受力，输入应该是荷载滑块，输出是上方这个经过约束后的荷载")
maximize_load_p_per_node = Panel(objective_maximize_feasible_load_p)

# ----
panel_30 = Panel(number_2)

# ---- group: Opossum: maximize load + minimize displacement
# Multi-objective setup: Variables: rotation angle and load P. Minimize BOTH objectives: (-P, maximum upper-node displacement). Keep displacement <= 0.431399 m and existing solver checks. Invalid candidates receive (1e6,1e6). Material stiffness is still uncalibrated. Load range currently includes zero.
negate_load = Panel("-1")
penalty_for_both_minimized_objectives = Panel("1000000")
negative_load_p = Multiplication(A=load_per_upper_node_p, B=negate_load)
feasibility_filter = StreamFilter(Gate=within_limit_and_solver_check, Stream0=penalty_for_both_minimized_objectives, Stream1=negative_load_p)
feasibility_filter_2 = StreamFilter(Gate=within_limit_and_solver_check, Stream0=penalty_for_both_minimized_objectives, Stream1=raw_maximum_displacement_m)
obj_2_minimize_displacement_m = Number(feasibility_filter_2)
obj_1_minimize_negative_load = Number(feasibility_filter)
obj_1_minimize_negative_load_2 = Panel(obj_1_minimize_negative_load)
obj_2_minimize_displacement_m_2 = Panel(obj_2_minimize_displacement_m)

# ---- group: Outcome of curve and point
geometry_4 = Geometry(zombie_loaded.O)  # disabled
number_slider_4 = Slider(1, range=0..10)  # disabled
length_3 = Length(Curve=geometry_4)  # disabled
lng_2 = ListLength(List=divide_domain)  # disabled
larger_than_5 = LargerThan(FirstNumber=length_3, SecondNumber=number_slider_4)  # -> LargerThan, OrEqualTo; disabled
dispatch_2 = Dispatch(List=geometry_4, DispatchPattern=larger_than_5.LargerThan)  # -> ListA, ListB; disabled
geometry_5 = Geometry(dispatch_2.ListA)  # disabled
geometry_6 = Geometry(dispatch_2.ListB)  # disabled
clean_2 = CleanTree(RemoveNulls=True, RemoveInvalid=True, RemoveEmpty=False, Tree=geometry_6)  # disabled
partition_2 = PartitionList(List=flatten(clean_2), Size=lng_2)  # disabled
join_2 = JoinCurves(Curves=partition_2, Preserve=False)  # disabled
end_points_2 = EndPoints(Curve=geometry_5)  # -> Start, End; disabled
end_3 = EndPoints(Curve=join_2)  # -> Start, End; disabled
ln_2 = Line(StartPoint=end_3.Start, EndPoint=end_3.End)  # disabled
point_2 = Point([end_points_2.End, end_points_2.Start])  # disabled
z_分界高度_h_2 = Slider(0.5, range=0..1)  # disabled
all_9_cables_2 = Line(flatten(ln_2))  # disabled
提取_xyz_2 = DeconstructPoint(Point=point_2, System=PlaneXY(0, 0, 0), rhinomcp_alias="z_coordinates", rhinomcp_graph_id="kangaroo_z_split_20261027")  # -> XCoordinate, YCoordinate, ZCoordinate; disabled
larger_than_6 = LargerThan(FirstNumber=提取_xyz_2.ZCoordinate, SecondNumber=z_分界高度_h_2)  # -> LargerThan, OrEqualTo; disabled
structure_3 = Curve(geometry_5)  # disabled
split_3 = SplitList(List=all_9_cables_2, Index=3)  # -> ListA, ListB; disabled
z_高度_2 = Panel(提取_xyz_2.ZCoordinate)  # disabled
split_4 = SplitList(List=split_3.ListB, Index=3)  # -> ListA, ListB; disabled
panel_31 = Panel(larger_than_6.LargerThan)  # disabled
按_z_分组_2 = Dispatch(
    List=point_2,
    DispatchPattern=larger_than_6.LargerThan,
    rhinomcp_alias="split_by_z",
    rhinomcp_graph_id="kangaroo_z_split_20261027")  # -> ListA, ListB; disabled
上层点_z_h_2 = Point(按_z_分组_2.ListA)  # disabled
下层点_z_h_2 = Point(按_z_分组_2.ListB, rhinomcp_alias="lower_points", rhinomcp_graph_id="kangaroo_z_split_20261027")  # disabled
upper_triangle_3_cables_2 = Line(split_4.ListA)  # disabled
connecting_3_cables_2 = Line(split_3.ListA)  # disabled
lower_triangle_3_cables_2 = Line(split_4.ListB)  # disabled

# ---- group: 小扰动稳定性实验 / Native Kangaroo ±0.1 mm
# HOW TO USE | 使用说明: 小扰动试验 / Perturbation Lab
# 
# 1. 原荷载 P 调为 0.55；Run=True。
# 2. 看 Gain<1、DECAYED，扰动衰减。
# 3. 原荷载 P 调为 0.58，再看 AMPLIFIED。
# 4. Run=False 暂停；改输入后旧结果隐藏。
# 
# Amplitude 单位 mm；默认正负各 0.1 mm。
# Steps 是求解迭代预算，不是物理时间。
# 结果使用当前模型、静长与原始荷载。
# 不改写原求解器，也不自动连接优化器。
# 
# Chart 曲线顺序：对照、负扰动、正扰动、增益1线。
# 横轴迭代进程，纵轴 log10(增益)。
# 低于0衰减，高于0放大。
# 
# lambda_min 是凝聚切线矩阵最小特征值。
# 只能用于当前87节点、直线拉紧索的弹簧模型。
# 侧向模态方向可能随数值误差旋转，正负方向无固定左右含义。
amplitude_mm_扰动 = Slider(0.1, range=0.0001..1)
iteration_budget_迭代 = Slider(300000, range=10000..500000)
run_test_运行试验 = BooleanToggle(True)
perturbation_lab_小扰动试验 = GhPythonScript(
    V=flatten(zombie_loaded.V),
    Cables=flatten(length_line_5),
    Struts=flatten(length_line_6),
    Anchors=flatten(anchor_3),
    Loads=flatten(load_2),
    I=zombie_loaded.I,
    Run=run_test_运行试验,
    Amplitude_mm=amplitude_mm_扰动,
    Steps=iteration_budget_迭代)  # -> out, Report, LambdaMin, GainMinus, GainPlus, Reference, Initial, Minus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; inputs V: list, Cables: list, Struts: list, Anchors: list, Loads: list
# ---------- perturbation_lab_小扰动试验: Python ----------
# -*- coding: utf-8 -*-
"""Live, finite-amplitude Kangaroo check for this 90-segment / 3-strut model.
No document mutation. Run three NEW physical systems, never shared GH goals.
This source is embedded in the installed GhPython component (no file dependency).
"""
import math

def magnitude(v):
    return math.sqrt(sum(x*x for x in v))

def unwrap(value):
    return value.ScriptVariable() if hasattr(value, 'ScriptVariable') else value

def coordinates(value):
    v=unwrap(value)
    return [float(v.X),float(v.Y),float(v.Z)]

def snapshot(positions,cables,struts,anchors,loads):
    s=dict(positions=[coordinates(p) for p in positions],springs=[],anchors=[],loads=[])
    for group,goals in [('cable',cables),('strut',struts)]:
        for item in goals:
            g=unwrap(item)
            if g.GetType().FullName!='KangarooSolver.Goals.Spring':raise ValueError('Only native Spring goals are supported')
            s['springs'].append(dict(nodes=[int(i) for i in g.PIndex],rest=float(g.RestLength),k=float(g.Stiffness),kind=group))
    for item in anchors:
        g=unwrap(item)
        if g.GetType().FullName!='KangarooSolver.Goals.Anchor':raise ValueError('Only finite Anchor goals are supported')
        s['anchors'].append(dict(node=int(g.PIndex[0]),target=coordinates(g.Pt),k=float(g.Strength)))
    for item in loads:
        g=unwrap(item)
        if g.GetType().FullName!='KangarooSolver.Goals.Unary':raise ValueError('Only constant Unary loads are supported')
        s['loads'].append(dict(node=int(g.PIndex[0]),force=coordinates(g.Force)))
    n=len(s['positions'])
    if n!=87 or len(s['springs'])!=93 or len(s['anchors'])!=3 or len(s['loads'])!=3:raise ValueError('Expected current 87-node, 90-cable-segment, 3-strut model')
    for g in s['springs']:
        if len(g['nodes'])!=2 or any(i<0 or i>=n for i in g['nodes']):raise ValueError('Goal particle indexing does not match solver V')
        if g['k']<=0 or g['rest']<=0:raise ValueError('Positive stiffness and rest length required')
    return s

def residual(s,positions):
    forces=[[0.,0.,0.] for p in positions]
    for g in s['springs']:
        a,b=g['nodes'];d=[positions[b][j]-positions[a][j] for j in range(3)];l=magnitude(d)
        if l<1e-12:raise ValueError('Degenerate spring')
        f=g['k']*(l-g['rest'])
        for j in range(3):forces[a][j]+=f*d[j]/l;forces[b][j]-=f*d[j]/l
    for g in s['anchors']:
        for j in range(3):forces[g['node']][j]+=g['k']*(g['target'][j]-positions[g['node']][j])
    for g in s['loads']:
        for j in range(3):forces[g['node']][j]+=g['force'][j]
    return max(magnitude(f) for f in forces)

def smallest_eigenpair(matrix):
    n=len(matrix);a=[list(row) for row in matrix];v=[[float(i==j) for j in range(n)] for i in range(n)]
    for iteration in range(100*n*n):
        p,q=0,1;maximum=0.
        for i in range(n):
            for j in range(i+1,n):
                if abs(a[i][j])>maximum:maximum=abs(a[i][j]);p,q=i,j
        if maximum<1e-11:
            index=min(range(n),key=lambda i:a[i][i])
            return a[index][index],[v[i][index] for i in range(n)]
        app,aqq,apq=a[p][p],a[q][q],a[p][q]
        angle=.5*math.atan2(2*apq,aqq-app);c,ss=math.cos(angle),math.sin(angle)
        for k in range(n):
            if k!=p and k!=q:
                akp,akq=a[k][p],a[k][q]
                a[k][p]=a[p][k]=c*akp-ss*akq;a[k][q]=a[q][k]=ss*akp+c*akq
        a[p][p]=c*c*app-2*ss*c*apq+ss*ss*aqq
        a[q][q]=ss*ss*app+2*ss*c*apq+c*c*aqq;a[p][q]=a[q][p]=0.
        for k in range(n):
            vp,vq=v[k][p],v[k][q];v[k][p]=c*vp-ss*vq;v[k][q]=ss*vp+c*vq
    raise ValueError('Eigen solver iteration limit')

def weakest_mode(s):
    corners=sorted(set(i for g in s['springs'][90:] for i in g['nodes']))
    if len(corners)!=6:raise ValueError('Expected six strut corners')
    mapping=dict((node,i) for i,node in enumerate(corners));springs=[];chains=[]
    for j in range(9):
        chain=s['springs'][10*j:10*j+10];a,b=chain[0]['nodes'][0],chain[-1]['nodes'][1]
        if a not in mapping or b not in mapping:raise ValueError('Cable chain endpoints mismatch')
        for i,g in enumerate(chain):
            if i and g['nodes'][0]!=chain[i-1]['nodes'][1]:raise ValueError('Cable chain ordering mismatch')
            length=magnitude([s['positions'][g['nodes'][1]][k]-s['positions'][g['nodes'][0]][k] for k in range(3)])
            if g['k']*(length-g['rest'])<=0:raise ValueError('Slack/compressed cable: this exact condensation is inapplicable')
        x,y=s['positions'][a],s['positions'][b];d=[y[k]-x[k] for k in range(3)];l2=sum(t*t for t in d)
        for g in chain:
            q=[s['positions'][g['nodes'][0]][k]-x[k] for k in range(3)];t=sum(q[k]*d[k] for k in range(3))/l2
            if magnitude([q[k]-t*d[k] for k in range(3)])>1e-5:raise ValueError('Cable is not straight: exact condensation is inapplicable')
        springs.append(dict(nodes=[a,b],k=1./sum(1./g['k'] for g in chain),rest=sum(g['rest'] for g in chain)))
        chains.append(chain)
    springs.extend(s['springs'][90:]);K=[[0.]*18 for i in range(18)]
    for g in springs:
        a,b=g['nodes'];d=[s['positions'][b][j]-s['positions'][a][j] for j in range(3)];l=magnitude(d);unit=[t/l for t in d]
        for j in range(3):
            for k in range(3):
                value=g['k']*((1.-g['rest']/l if j==k else 0.)+g['rest']/l*unit[j]*unit[k])
                ia,ib=3*mapping[a]+j,3*mapping[b]+j;ja,jb=3*mapping[a]+k,3*mapping[b]+k
                K[ia][ja]+=value;K[ib][jb]+=value;K[ia][jb]-=value;K[ib][ja]-=value
    for g in s['anchors']:
        for j in range(3):K[3*mapping[g['node']]+j][3*mapping[g['node']]+j]+=g['k']
    value,vector=smallest_eigenpair(K);scale=max(magnitude(vector[3*i:3*i+3]) for i in range(6))
    mode=[[0.,0.,0.] for p in s['positions']]
    for node,i in mapping.items():mode[node]=[v/scale for v in vector[3*i:3*i+3]]
    for chain in chains:
        a,b=chain[0]['nodes'][0],chain[-1]['nodes'][1];x,y=s['positions'][a],s['positions'][b];d=[y[k]-x[k] for k in range(3)];l2=sum(t*t for t in d)
        for g in chain:
            node=g['nodes'][0];t=sum((s['positions'][node][k]-x[k])*d[k] for k in range(3))/l2
            mode[node]=[mode[a][k]*(1-t)+mode[b][k]*t for k in range(3)]
    return value,mode,corners

def run_experiment(s,amplitude,max_iterations):
    import clr,time
    clr.AddReference('KangarooSolver')
    import KangarooSolver as KS
    from KangarooSolver.Goals import Spring,Anchor,Unary
    from Rhino.Geometry import Point3d,Vector3d
    from System.Collections.Generic import List
    if not (1e-7<=amplitude<=.001):raise ValueError('Amplitude must be 0.0001 to 1 mm')
    max_iterations=int(max_iterations)
    if not (10000<=max_iterations<=500000):raise ValueError('Iteration budget must be 10000 to 500000')
    initial_residual=residual(s,s['positions'])
    if initial_residual>1e-5:raise ValueError('Input is not equilibrated (residual %.3g). Solve the original Zombie first.'%initial_residual)
    eigen,mode,corners=weakest_mode(s);start=time.time();systems=[]
    for sign in [0,-1,1]:
        ps=KS.PhysicalSystem()
        for p,v in zip(s['positions'],mode):ps.AddParticle(Point3d(*[p[k]+sign*amplitude*v[k] for k in range(3)]),1.)
        goals=List[KS.IGoal]()
        for g in s['springs']:goals.Add(Spring(g['nodes'][0],g['nodes'][1],g['rest'],g['k']))
        for g in s['anchors']:goals.Add(Anchor(g['node'],Point3d(*g['target']),g['k']))
        for g in s['loads']:goals.Add(Unary(g['node'],Vector3d(*g['force'])))
        systems.append((ps,goals))
    def measure():
        control=systems[0][0];ratios=[]
        relative=[]
        for ps,goals in systems:
            ratios.append(max(ps.GetPosition(node).DistanceTo(Point3d(*s['positions'][node])) for node in corners)/amplitude)
            relative.append(max(ps.GetPosition(node).DistanceTo(control.GetPosition(node)) for node in corners)/amplitude)
        return dict(iterations=int(control.GetIterations()),iterationCounts=[int(ps.GetIterations()) for ps,goals in systems],control=ratios[0],minus=ratios[1],plus=ratios[2],relativeMinus=relative[1],relativePlus=relative[2])
    trace=[measure()]
    for step in range(max_iterations):
        # Native Step batches iterations adaptively. Record each system's actual
        # count and stop it independently when its soft iteration budget is met.
        for ps,goals in systems:
            if ps.GetIterations()<max_iterations:ps.Step(goals,False,1e-16)
        trace.append(measure())
        if min(ps.GetIterations() for ps,goals in systems)>=max_iterations:break
    if trace[-1]['iterations']!=int(systems[0][0].GetIterations()):trace.append(measure())
    final=[[[p.X,p.Y,p.Z] for p in ps.GetPositions()] for ps,goals in systems]
    residuals=[residual(s,positions) for positions in final]
    ratios=[trace[-1]['minus'],trace[-1]['plus']];gain=max(ratios)
    if gain>10:response='AMPLIFIED / 扰动放大'
    elif gain<.2 and trace[-1]['control']<.2 and max(residuals)<1e-6:response='DECAYED / 扰动衰减'
    else:response='INCONCLUSIVE / 延长迭代或减小扰动后复查'
    tangent='POSITIVE / 当前平衡局部稳定' if eigen>1e-6 else ('NEGATIVE / 当前平衡不稳定' if eigen< -1e-6 else 'NEAR ZERO / 临界附近')
    return dict(lambdaMin=eigen,mode=mode,corners=corners,amplitude=amplitude,trace=trace,ratios=ratios,response=response,tangent=tangent,positions=final,residuals=residuals,initialResidual=initial_residual,controlDrift=max(magnitude([final[0][n][k]-s['positions'][n][k] for k in range(3)]) for n in corners),iterations=[int(ps.GetIterations()) for ps,goals in systems],seconds=time.time()-start)

# -*- coding: utf-8 -*-
# Installer embeds perturbation_core.py immediately above this wrapper.
# Inputs: V,Cables,Struts,Anchors,Loads,I,Run,Amplitude_mm,Steps
# Outputs: Report,LambdaMin,GainMinus,GainPlus,Reference,Initial,Minus,Plus,Chart,Trace
import scriptcontext as sc
from Rhino.Geometry import Point3d,Line,Polyline
from Grasshopper.Kernel import GH_RuntimeMessageLevel
Report='Set Run=True to compute. Run=False pauses testing; change inputs then enable Run again.'
LambdaMin=[];GainMinus=[];GainPlus=[]
Reference=[];Initial=[];Minus=[];Plus=[];Chart=[];Trace=[]
try:
    system=snapshot(V,Cables,Struts,Anchors,Loads)
    if int(I)>=10000:raise ValueError('Original Zombie reached its iteration limit')
    amplitude=float(Amplitude_mm)*.001
    key=('tensegrity-perturbation-v1',str(ghenv.Component.InstanceGuid))
    signature=repr((system,amplitude,int(Steps)))
    cached=sc.sticky.get(key)
    if bool(Run) and (cached is None or cached[0]!=signature):
        cached=(signature,run_experiment(system,amplitude,int(Steps)))
        sc.sticky[key]=cached
    if cached is not None and cached[0]==signature:
        result=cached[1];LambdaMin=result['lambdaMin'];GainMinus,GainPlus=result['ratios']
        def members(positions):
            return [Line(Point3d(*positions[g['nodes'][0]]),Point3d(*positions[g['nodes'][1]])) for g in system['springs']]
        Reference=members(system['positions'])
        Initial=members([[p[j]+amplitude*v[j] for j in range(3)] for p,v in zip(system['positions'],result['mode'])])
        Minus=members(result['positions'][1]);Plus=members(result['positions'][2])
        Trace=['control_iterations,minus_iterations,plus_iterations,control_gain,minus_gain,plus_gain,relative_minus,relative_plus']+['%d,%d,%d,%.9g,%.9g,%.9g,%.9g,%.9g'%(t['iterationCounts'][0],t['iterationCounts'][1],t['iterationCounts'][2],t['control'],t['minus'],t['plus'],t['relativeMinus'],t['relativePlus']) for t in result['trace']]
        last=max(1,max(result['iterations']))
        # Separate XY plot beside the model: width=2 m, y=log10(amplification).
        for index,name in enumerate(['control','minus','plus']):
            Chart.append(Polyline([Point3d(2.+2.*t['iterationCounts'][index]/last,math.log10(max(1e-8,t[name])),0.) for t in result['trace']]).ToNurbsCurve())
        Chart.append(Line(Point3d(2,0,0),Point3d(4,0,0)).ToNurbsCurve())
        Report=('小扰动试验 / Perturbation test\n%s\n%s\nlambda_min = %.9g\nAmplitude = %.6g mm (each sign)\nGain (- / +) = %.6g / %.6g\nIterations = %s\nInitial residual = %.3g\nFinal residuals (control / - / +) = %s\nControl drift = %.6g m\nElapsed = %.2f s\n\nGain = maximum corner distance from ORIGINAL equilibrium / initial amplitude.\nChart: x=iteration fraction; y=log10(gain); horizontal line=gain 1.\nThe unperturbed control can also leave an unstable equilibrium due to numerical noise.\nTrace includes distance from control; coincident final states do not imply stability.\nFinite perturbation response is not a proof of global stability.\nThis check assumes this model\'s straight taut cables, axial springs and finite anchors.\nThe plotted evolution is solver iteration, not physical time.')%(result['response'],result['tangent'],LambdaMin,float(Amplitude_mm),GainMinus,GainPlus,result['iterations'],result['initialResidual'],', '.join('%.3g'%r for r in result['residuals']),result['controlDrift'],result['seconds'])
        ghenv.Component.Message=result['response'].split(' / ')[0]
    else:
        Report='尚未计算当前输入。Set Run=True to compute the CURRENT model; previous geometry/results are hidden.'
        ghenv.Component.Message='READY / 待运行'
except Exception as error:
    Report='试验未运行 / Check failed: '+str(error)
    ghenv.Component.AddRuntimeMessage(GH_RuntimeMessageLevel.Warning,Report)
    ghenv.Component.Message='CHECK INPUT'
# ---------- end perturbation_lab_小扰动试验 ----------
result_试验结果 = Panel(perturbation_lab_小扰动试验.Report)
reference = Data(perturbation_lab_小扰动试验.Reference)
initial = Data(perturbation_lab_小扰动试验.Initial)
minus = Data(perturbation_lab_小扰动试验.Minus)
plus = Data(perturbation_lab_小扰动试验.Plus)
chart = Data(perturbation_lab_小扰动试验.Chart)

# ---- group: Galapagos - equal-weight load and displacement
# Galapagos weighted single objective: MINIMIZE F = 0.5*(1-P/P_ref) + 0.5*(u/0.431399). Genome: angle and load P. Equal weights are an initial preference, not a unique physical optimum. Invalid solutions receive 1e6. P_ref=1 matches current load maximum; update reference if range changes. Run Galapagos or Opossum separately.
load_reference_p_ref_match_load_range = Panel("1.0")
one = Panel("1")
allowed_maximum_displacement_m_2 = Panel("0.50")
p_p_ref = Division(A=load_per_upper_node_p, B=load_reference_p_ref_match_load_range)
_1_p_p_ref = Subtraction(A=one, B=p_p_ref)
u_u_limit = Division(A=raw_maximum_displacement_m, B=allowed_maximum_displacement_m_2)
displacement_weight = Panel("0.5")
load_weight = Panel("0.5")
weighted_displacement = Multiplication(A=u_u_limit, B=displacement_weight)
weighted_load_cost = Multiplication(A=_1_p_p_ref, B=load_weight)
combined_normalized_fitness = Addition(A=weighted_load_cost, B=weighted_displacement)
invalid_solution_penalty = Panel("1000000")
reject_invalid_solutions = StreamFilter(Gate=within_limit_and_solver_check, Stream0=invalid_solution_penalty, Stream1=combined_normalized_fitness)
galapagos_fitness_minimize = Number(reject_invalid_solutions)
fitness_lower_is_better = Panel(galapagos_fitness_minimize)

# ---- group: Top mesh simulation
interpolate = Interpolate(Vertices=上层点_z_h, Degree=1, Periodic=True, KnotStyle=1)  # -> Curve, Length, Domain; disabled
三角面心 = Area(Geometry=interpolate.Curve)  # -> Area, Centroid; disabled
中心荷载幅值_相对 = Slider(0.2, range=0..1)  # disabled
角点_面心种子网格 = DelaunayMesh(
    Points=[上层点_z_h, 三角面心.Centroid],
    Plane=PlaneXY(0, 0, 0),
    rhinomcp_alias="seed_triangle",
    rhinomcp_graph_id="top_triangle_net_20261027")  # disabled
向下_z = Negative(Value=中心荷载幅值_相对, rhinomcp_alias="negative", rhinomcp_graph_id="top_triangle_net_20261027")  # disabled
网格边长 = Slider(0.08, range=0.04..0.2)  # disabled
向下集中荷载 = UnitZ(Factor=向下_z)  # disabled
面心节点_load = Load(Point=flatten(三角面心.Centroid), ForceVector=向下集中荷载, Weighting=1)  # disabled
三角网格_含面心节点 = TriRemesh(
    Geometry=flatten(角点_面心种子网格),
    Sharp=True,
    Features=[上层点_z_h, 三角面心.Centroid],
    Length=网格边长,
    Iterations=50,
    rhinomcp_alias="remesh",
    rhinomcp_graph_id="top_triangle_net_20261027")  # -> Triangulation, Dual, Creases; disabled
固定三个角点 = Anchor(Point=flatten(上层点_z_h), Strength=1000000)  # disabled
输出变形网面 = Show(G=flatten(三角网格_含面心节点.Triangulation), rhinomcp_alias="show_mesh", rhinomcp_graph_id="top_triangle_net_20261027")  # disabled
重置网面_reset = Button(rhinomcp_alias="reset", rhinomcp_graph_id="top_triangle_net_20261027")  # disabled
网面运行_on = BooleanToggle(True)  # disabled

# ---- group: Top mesh simulation / 绳索本构 · 只受拉 / 静长＝初长×比例
初始网格边线 = MeshEdges(Mesh=三角网格_含面心节点.Triangulation, rhinomcp_alias="initial_edges", rhinomcp_graph_id="top_triangle_net_20261027")  # -> NakedEdges, InteriorEdges, NonManifoldEdges; disabled
网边刚度_相对 = Slider(10, range=0.1..100)  # disabled
全部绳段 = Line([初始网格边线.NakedEdges, 初始网格边线.InteriorEdges], rhinomcp_alias="rope_segments", rhinomcp_graph_id="top_triangle_net_20261027")  # disabled
静长比例_预张力 = Slider(1, range=0..1)  # disabled
每段初始长度 = Length(Curve=全部绳段, rhinomcp_alias="initial_lengths", rhinomcp_graph_id="top_triangle_net_20261027")  # disabled
每段绳索静长 = Multiplication(A=每段初始长度, B=静长比例_预张力, rhinomcp_alias="rope_rest_lengths", rhinomcp_graph_id="top_triangle_net_20261027")  # disabled
绳索只受拉 = ClampLength(
    Line=全部绳段,
    LowerLimit=0,
    UpperLimit=每段绳索静长,
    Strength=网边刚度_相对,
    rhinomcp_alias="tension_only",
    rhinomcp_graph_id="top_triangle_net_20261027")  # disabled

# ---- group: Top mesh simulation (continued)
三角绳网求解 = BouncySolver(
    GoalObjects=[固定三个角点, 面心节点_load, 输出变形网面, 绳索只受拉],
    Reset=重置网面_reset,
    Threshold=1e-08,
    Tolerance=0.0001,
    Damping=0.9,
    Iterations=20,
    On=网面运行_on)  # -> I, V, O; disabled
只提取变形网面 = GhPythonScript(G=flatten(三角绳网求解.O), rhinomcp_alias="mesh_type_filter", rhinomcp_graph_id="top_triangle_net_20261027")  # -> out, M; inputs G: list; disabled
#   port G: Kangaroo goal outputs, including nulls, lines and meshes
# ---------- 只提取变形网面: Python ----------
import Rhino.Geometry as rg
M = []
for item in G or []:
    if item is None:
        continue
    if hasattr(item, 'ScriptVariable'):
        item = item.ScriptVariable()
    if isinstance(item, rg.Mesh):
        M.append(item)
# ---------- end 只提取变形网面 ----------
变形后的三角绳网 = Mesh(只提取变形网面.M, rhinomcp_alias="deformed_mesh", rhinomcp_graph_id="top_triangle_net_20261027")  # disabled
变形绳网边线 = MeshEdges(Mesh=变形后的三角绳网, rhinomcp_alias="deformed_edges", rhinomcp_graph_id="top_triangle_net_20261027")  # -> NakedEdges, InteriorEdges, NonManifoldEdges; disabled

# ---- group: Analysis 中心下挠 ΔZ · 同一网格节点前后对比
初始网格节点 = DeconstructMesh(Mesh=三角网格_含面心节点.Triangulation, rhinomcp_alias="rest_vertices", rhinomcp_graph_id="top_triangle_net_20261027")  # -> Vertices, Faces, Colours, Normals; disabled
变形后的节点 = DeconstructMesh(Mesh=变形后的三角绳网, rhinomcp_alias="solved_vertices", rhinomcp_graph_id="top_triangle_net_20261027")  # -> Vertices, Faces, Colours, Normals; disabled
找到面心节点编号 = ClosestPoint(Point=三角面心.Centroid, Cloud=初始网格节点.Vertices, rhinomcp_alias="center_index", rhinomcp_graph_id="top_triangle_net_20261027")  # -> ClosestPoint, CPIndex, Distance; disabled
同一个面心节点 = ListItem(
    List=变形后的节点.Vertices,
    Index=找到面心节点编号.CPIndex,
    Wrap=True,
    rhinomcp_alias="solved_center",
    rhinomcp_graph_id="top_triangle_net_20261027")  # disabled
原始面心_z_2 = DeconstructPoint(Point=三角面心.Centroid, System=PlaneXY(0, 0, 0), rhinomcp_alias="z_before", rhinomcp_graph_id="top_triangle_net_20261027")  # -> XCoordinate, YCoordinate, ZCoordinate; disabled
变形后面心_z_2 = DeconstructPoint(Point=同一个面心节点, System=PlaneXY(0, 0, 0), rhinomcp_alias="z_after", rhinomcp_graph_id="top_triangle_net_20261027")  # -> XCoordinate, YCoordinate, ZCoordinate; disabled
中心下挠_δz_4 = Subtraction(
    A=原始面心_z_2.ZCoordinate,
    B=变形后面心_z_2.ZCoordinate,
    rhinomcp_alias="center_sag",
    rhinomcp_graph_id="top_triangle_net_20261027")  # disabled
中心下挠_模型单位_2 = Panel(中心下挠_δz_4)  # disabled

# ==== cluster DeskGeometry
F = ClusterInput()
B = ClusterInput()
D = ClusterInput()
R = ClusterInput()
mres = ClusterInput()
t = ClusterInput()
geo = ClusterInput()
geo_2 = Geometry(geo)
item = ListItem(List=geo_2, Index=0, Wrap=True)  # -> Item, Item1, Item2
ln = Line(StartPoint=item.Item, EndPoint=item.Item1)
curvepoint = PointOnCurve(ln, parameter=0.5)
Y = UnitY(Factor=F)
move = Move(Geometry=curvepoint, Motion=expr("-x", Y))  # -> Geometry, Transform
circle = Circle3Pt(PointA=item.Item, PointB=item.Item1, PointC=move.Geometry)  # -> Circle, Plane, Radius
panel = Panel(circle.Radius)
crv_cp = CurveClosestPoint(Point=curvepoint, Curve=circle.Circle)  # -> Point, Parameter, Distance
seam = Seam(Curve=reparameterize(circle.Circle), Seam=t)
ln_2 = Line(StartPoint=crv_cp.Point, EndPoint=item.Item2)
len = Length(Curve=ln_2)
addition = Addition(A=len, B=B)
offset = OffsetCurve(Curve=seam, Distance=expr("-x", addition), Corners=1)
offset_2 = OffsetCurve(Curve=seam, Distance=D, Corners=1)
rulesrf = RuledSurface(CurveA=offset, CurveB=offset_2)
sdivide = DivideSurface(Surface=rulesrf, UCount=Slider(8, range=0..10), VCount=1)  # -> Points, Normals, Parameters
flip = FlipMatrix(Data=sdivide.Points)
bang = ExplodeTree(Data=flip)  # -> _000000, _000001
ln_3 = Line(StartPoint=bang._000000, EndPoint=bang._000001)
len_2 = Length(Curve=ln_3)
srfsplit = SurfaceSplit(Surface=rulesrf, Curves=ln_3)
panel_2 = Panel(len_2)
item_2 = ListItem(List=srfsplit, Index=Slider(10, range=0..10), Wrap=True)
area = Area(Geometry=item_2)  # -> Area, Centroid
panel_3 = Panel(area.Area)
fillet = Fillet(Curve=item_2, Radius=R)

# ---- group: Mesh Breps (Karamba3D)
mesh_breps = MeshBrepsKaramba3D(
    Brep=fillet,
    InclusionPoints=geo_2,
    MeshResolution=mres,
    EdgeRefinementFactor=0.67,
    PointReduction=False,
    SmoothingStepSize=0,
    SmoothingIterations=5)  # -> Mesh, Info

# ----
medges = MeshEdges(Mesh=mesh_breps.Mesh)  # -> NakedEdges, InteriorEdges, NonManifoldEdges
mesh = ClusterOutput(mesh_breps.Mesh)
L = ClusterOutput(ln_3)
C = ClusterOutput(offset)
C_2 = ClusterOutput(offset_2)
